# Grasshopper definition AgentSworm.gh (Grasshopper 0.9.75)
# plug-ins: Python Interpreter, Kangaroo Components

timer = Timer(TimerInterval=20, Target=runner_2)  # disabled
timer_2 = Timer(TimerInterval=20, Target=runner)  # disabled
runner = PythonScript(reset=Toggle(True), stop=Toggle(False), record=Toggle(False), dataNum=Slider(188, range=0..500))  # -> out, rect, xy, pos, pathData
# ---------- runner: Python ----------
ghenv.Component.Message = "written by +GENEATCG"

import rhinoscriptsyntax as rs 
import Rhino as rc

rectX = 100
rectY = 100

class Runner:
    def __init__(self, x, y, mx, my):
        self.x = x
        self.y = y
        self.mx = mx
        self.my = my
        self.path = []
        
    def pt(self):
        self.x += mx
        self.y += my
        return self.x,self.y
    
    def reflect(self):
        if self.x >= rectX or self.x <= 0:
            self.mx *= -1
        if self.y >= rectY or self.y <= 0:
            self.my *= -1
        return self.mx, self.my
        
    def recordPath(self, x):
        self.path.append(x)
        
    def deletePath(self, n):
        if len(self.path) > n:
            self.path.pop(0)

if reset:
    run = Runner(3,5,1,2)
    c = rs.AddPoint(run.x, run.y, 0)
else:
    if not stop:
        mx, my = run.reflect()
        x, y = run.pt()
        xy = x, y
        pos = rs.AddPoint(x, y, 0)
        if record:
            run.recordPath(rc.Geometry.Point3d(x,y,0))
            pathData = run.path
        else:
            pathData = run.path
    else:
        pos = rs.AddPoint(x, y, 0)
        pathData = run.path
    run.deletePath(dataNum)


plane = rs.WorldXYPlane()

rect = rs.AddRectangle(plane, rectX, rectY)
# ---------- end runner ----------
runner_2 = PythonScript(
    reset=Toggle(True),
    stop=Toggle(False),
    ms=Slider(4, range=0..4),
    mc=Slider(0.001, range=0..0.003),
    ma=Slider(0.1, range=0..0.1),
    bound=Toggle(True))  # -> out, rect, pos, vec, ln
# ---------- runner_2: Python ----------
ghenv.Component.Message = "written by +GENEATCG"

import rhinoscriptsyntax as rs 
import Rhino as rc
from random import *

rectX = 600
rectY = 600

class Runner:
    def __init__(self, p, v):
        self.p = p
        self.v = v
        self.a = rs.VectorCreate( (0,0,0),(0,0,0) )
        
    def ptRun(self):
        self.v = rs.VectorAdd(self.v, self.a)
        v = rs.VectorLength(self.v)
        if v > 2:
            self.v = rs.VectorScale(rs.VectorUnitize(self.v), 2)
        self.p = rs.VectorAdd(self.p, self.v)
        
        self.a = rs.VectorCreate( (0,0,0),(0,0,0) )
    
    def reflect(self):
        if self.p[0] >= rectX or self.p[0] < 0:
            self.v[0] *= -1.2
        if self.p[1] >= rectY or self.p[1] < 0:
            self.v[1] *= -1.2
    
    def door(self):
        if self.p[0] >= rectX:
            self.p[0] -= rectX
        if self.p[0] <= 0:
            self.p[0] += rectX
        if self.p[1] >= rectY:
            self.p[1] -= rectY
        if self.p[1] <= 0:
            self.p[1] += rectY
        
    
    def flock(self):
        self.separate(ms)
        self.cohesion(mc)
        self.align(ma)
    
    def align(self, mag):
        
        steer = rs.VectorCreate( (0,0,0) , (0,0,0) )
        count = 0
        
        for i in pts:
            distance = rs.Distance(i.p, self.p)
            if distance > 0 and distance < 40:
                steer = rs.VectorAdd(steer, i.v)
                count += 1
        
        if count>0:
            steer = rs.VectorScale(steer, 1.0/count)
        
        steer = rs.VectorScale(steer, mag)
        self.a = rs.VectorAdd(self.a, steer)
    
    def cohesion(self, mag):
        
        sum = rs.VectorCreate( (0,0,0) , (0,0,0) )
        count = 0
        
        for i in pts:
            distance = rs.Distance(i.p, self.p)
            if distance > 0 and distance < 60:
                sum = rs.VectorAdd(sum, i.p)
                count += 1
        
        if count>0:
            sum = rs.VectorScale(sum, 1.0/count)
        
        steer = rs.VectorSubtract(sum, self.p)
        steer = rs.VectorScale(steer, mag)
        self.a = rs.VectorAdd(self.a, steer)
        #print(self.a)
    
    def separate(self, mag):
        
        steer = rs.VectorCreate( (0,0,0) , (0,0,0) )
        count = 0
        
        for i in pts:
            distance = rs.Distance(i.p, self.p)
            if distance > 0 and distance < 30:
                diff = rs.VectorSubtract(self.p, i.p)
                diff = rs.VectorUnitize(diff)
                diff = rs.VectorScale(diff, 1.0/distance)
                
                steer = rs.VectorAdd(steer , diff)
                count += 1
        
        if count>0:
            steer = rs.VectorScale(steer, 1.0/count)
        
        steer = rs.VectorScale(steer, mag)
        
        self.a = rs.VectorAdd(self.a, steer)
        #print(self.a)
    
    def drawPt(self):
        pt = rc.Geometry.Point3d(self.p[0], self.p[1], self.p[2])
        return pt

if reset:
    pts = []
    for i in range(20):
        p = rs.VectorCreate(   rs.AddPoint( randint(1,rectX-1),  randint(1,rectY-1),0  )  ,  rs.AddPoint(0,0,0)    )
        v = rs.VectorCreate(   rs.AddPoint( randint(1,3) ,  randint(1,3),0   )  ,  rs.AddPoint(0,0,0)    )
        run1 = Runner(p, v)
        pts.append(run1)
else:
    pos = []
    vec = []
    
    if not stop:
        for i in pts:
            pos.append(i.drawPt())
            vec.append(i.v)
        for i in pts:
            if bound:
                i.reflect()
            else:
                i.door()
            #i.separate(magnitude)
            i.flock()
            i.ptRun()
        
    else:
        for i in pts:
            pos.append(i.drawPt())
            vec.append(i.v)


plane = rs.WorldXYPlane()

rect = rs.AddRectangle(plane, rectX, rectY)
# ---------- end runner_2 ----------
panel = Panel(runner.pathData)
panel_2 = Panel(runner.xy)
panel_3 = Panel(runner.pos)
panel_4 = Panel(runner_2.vec)
panel_5 = Panel(runner_2.pos)
vdis = VectorDisplay(Anchor=panel_5, Vector=panel_4)
T = Trail(Points=panel_5, Reset=Button(), Record=Toggle(False))
panel_6 = Panel(T)
