# Grasshopper definition AutosurfacingOfMeshesD.gh (Grasshopper 1.0.4)
# plug-ins: Kangaroo Components, PlanktonGh, Weaverbird

reset = Button()
mesh = Mesh(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)

# ---- group: Crude Dual Mesh Cells
meshmachine = MeshMachine(
    Geometry=mesh,
    Length="0.25",
    Flip="0",
    PullStrength=0.8,
    CurvatureAdaptivity="0.7",
    BoundaryScale=1,
    BoundaryDistance=5,
    Exponent=2,
    Background=0.5,
    Iterations="10",
    Reset=reset)
pmesh = PlanktonMesh(meshmachine)
mesh_2 = Mesh(pmesh)
wbdual = WeaverbirdsDualGraph(MeshCurves=mesh_2, DualMode=0)

# ---- group: Fine Remeshing
meshmachine_2 = MeshMachine(
    Geometry=mesh,
    Length="0.04",
    Flip="0",
    PullStrength="0.1",
    CurvatureAdaptivity="0.8",
    BoundaryScale=1,
    BoundaryDistance=5,
    Exponent=2,
    Background=0.5,
    Iterations="10",
    Reset=reset)
pmesh_2 = PlanktonMesh(meshmachine_2)
mesh_3 = Mesh(pmesh_2)

# ----
explode = Explode(Curve=wbdual, Recursive=True)  # -> Segments, Vertices
divide = DivideCurve(Curve=explode.Segments, Count="13", Kinks=False)  # -> Points, Tangents, Parameters
meshcp = MeshClosestPoint(Point=divide.Points, Mesh=mesh_3)  # -> Point, Index, Parameter
intcrv = Interpolate(Vertices=meshcp.Point, Degree=3, Periodic=False, KnotStyle=1)  # -> Curve, Length, Domain
path_mapper = PathMapper(intcrv.Curve, source="{A;B;C;D}", target="{C}")
join = JoinCurves(Curves=path_mapper, Preserve=False)
fpatch = FragmentPatch(Boundary=wbdual)
area = Area(Geometry=fpatch)  # -> Area, Centroid
scale = Scale(Geometry=fpatch, Center=area.Centroid, Factor="0.6")  # -> Geometry, Transform
popgeo = PopulateGeometry(Geometry=scale.Geometry, Count="10", Seed=1)
meshcp_2 = MeshClosestPoint(Point=popgeo, Mesh=mesh_3)  # -> Point, Index, Parameter
meval = MeshEval(Mesh=mesh_3, Parameter=meshcp_2.Parameter)  # -> Point, Normal, Colour
circle = CircleCNR(Center=meval.Point, Normal=meval.Normal, Radius="0.003")  # -> simplify(Circle)
merge = Merge(Data1=circle, Data2=simplify(join))
preview = CustomPreview(Geometry=circle, Shader="Red")

# ---- group: Nik's Parallel Processing Patch
python__sdiff = PythonScript(Curves=merge, Spans="6", PointSpacing="2", Flexibility="5", Tolerance="0.0005")  # -> out, PATCHES; inputs Curves: tree of Curve, Spans: Int32
# ---------- python__sdiff: Python ----------
# Nik Willmore 2016 nikwillmore@gmail.com http://twitter.com/nikwillmore
# See: http://www.grasshopper3d.com/forum/topics/puffing-of-flat-surfaces-with-holes

import Rhino
import ghpythonlib.parallel # Parallel processing of Rhinocommon commands put in a function.

BRANCHES_CONTAINER = [];  CURVES_CONTAINER = []; PATCHES_CONTAINER = []

# The Python parallel processing command requires a function as input:
def patch_them(_parallel):

  PATCHES_CONTAINER.append([_parallel[0],Rhino.Geometry.Brep.CreatePatch(_parallel[1],None,Spans,Spans,True,False,PointSpacing,Flexibility,0,(False,False,False,False),Tolerance)]) # Forward our index number into each patch entry.
  # CreatePatch: geometry,startingSurface,uSpans,vSpans,trim?,tangency?,pointSpacing,flexibility,surfacePull,fixEdges?,tolerance
  # http://4.rhino3d.com/5/rhinocommon/?topic=html/M_Rhino_Geometry_Brep_CreatePatch_1.htm
  return True

for i,branch in enumerate(Curves.Branches): # Loop through Grasshopper tree base branches.

  CURVES_CONTAINER = Rhino.Collections.CurveList() # Initiate new curves list.
  for c in branch: # Convert a Python list into a Rhino list that avoids the CreatePatch IEnumerable error.
    CURVES_CONTAINER.Add(c)
  BRANCHES_CONTAINER.append([i,CURVES_CONTAINER]) # Include an index value for resorting after parallel step scrambles order.

ghpythonlib.parallel.run(patch_them, BRANCHES_CONTAINER, False) # <==Run the curve sets through the function in PARALLEL.

PATCHES_CONTAINER.sort(key=lambda x: x[0]) # Re-sort the parallel command disorded patches by their original order, via our index entry.

for p in PATCHES_CONTAINER:
  del p[0] # Nuke index numbers.
PATCHES_CONTAINER = [item for sublist in PATCHES_CONTAINER for item in sublist] # Flatten the input list now that index items are gone.

PATCHES = PATCHES_CONTAINER
# ---------- end python__sdiff ----------

# ---- group: Nik's Brep Join
python = GhPythonScript(Breps=python__sdiff.PATCHES, Tolerance="0.01")  # -> out, Joined; inputs Breps: list of Brep
# ---------- python: Python ----------
import Rhino

Joined = Rhino.Geometry.Brep.JoinBreps(Breps, Tolerance)
# ---------- end python ----------

# ---- group: Output
brep = Brep(python.Joined)

# ---- group: Preview
wires = BrepWireframe(Brep=brep, Density=-1)
preview_2 = CustomPreview(Geometry=brep, Shader="Pink")
preview_3 = CustomPreview(Geometry=wires, Shader="Black")
