# Grasshopper definition GHPython-example.gh (Grasshopper 0.9.76)
# plug-ins: Python Interpreter

pt = Point(<point referenced from the Rhino model>)
pt_2 = Point([<point referenced from the Rhino model> x6])
crv = Curve(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)
crv_2 = Curve(<curve referenced from the Rhino model>)
python = PythonScript(objs=crv_2)  # -> out, a; inputs objs: list
# ---------- python: Python ----------
import rhinoscriptsyntax as rs
import scriptcontext
import Rhino
  
if 1:
    for i in range(len(objs)):
        obj = objs[i]
        #get object properties
        print obj
        obj_id = obj
        print obj_id
        doc_object = rs.coercerhinoobject(obj_id)
        print doc_object
        attributes = doc_object.Attributes
        geometry = doc_object.Geometry
  
        #go to Rhino workspace
        scriptcontext.doc = Rhino.RhinoDoc.ActiveDoc
  
        #bake and select object
        rhino_obj = scriptcontext.doc.Objects.Add(geometry, attributes)
        rs.SelectObject(rhino_obj)
  
        #run command to bake and delete
        filename='C:\\Users\\MAC-WIN10\\Desktop\\object'
        save = filename+str(i)+".obj"
        formatted_text = '-_export "{0}" _Enter _Enter'.format(save)
        print formatted_text
        rs.Command(formatted_text)
#        rs.Command("_Delete")
  
        #back to GH workspace
        scriptcontext.doc = ghdoc
# ---------- end python ----------
python_2 = PythonScript(compPt=pt, Pts=pt_2, range=20)  # -> out, a; inputs Pts: list
# ---------- python_2: Python ----------
import ghpythonlib.components as gh
 
class component:
    def __init__(self, center, targets, range):
        self.center = center
        self.vectors = []
        for pt in targets:
            dist = gh.Distance(center,pt)
            if dist!=0 and dist<range:
                vec = gh.Vector2Pt(center,pt)
                self.vectors.append(vec)
     
    def skeleton(self):
        lines = []
        for vec in self.vectors:
            length = gh.VectorLength(vec)
            line = gh.LineSDL(self.center, vec, length*0.5)
            lines.append(line)
        return lines
     
    def geometry(self,radius):
        geos = []
        sph = gh.Sphere(gh.XYPlane(self.center),radius*1.2)
        geos.append(sph)
        for vec in self.vectors:
            length = gh.VectorLength(vec)
            line = gh.LineSDL(self.center, vec, length*0.5)
            pipe = gh.Pipe(line,radius,1)
            geos.append(pipe)
        geo = gh.SolidUnion(geos)
        return geo
 
a = component(compPt, Pts , range)
print a
a
# ---------- end python_2 ----------
python_3 = PythonScript(x=crv)  # -> out, a
# ---------- python_3: Python ----------
import rhinoscriptsyntax as rs
import scriptcontext as sc
import Rhino
 
sc.doc = ghdoc
 
#get object id from grasshopper
obj_id = x
#convert grasshopper object into rhino object
doc_obj = rs.coercerhinoobject(obj_id)
print doc_obj
#make attributes and geometry from rhino object
attributes = doc_obj.Attributes
geometry = doc_obj.Geometry
 
#go rhino document
sc.doc = Rhino.RhinoDoc.ActiveDoc
 
#bake object with attributes
rhino_obj = sc.doc.Objects.Add(geometry, attributes)
rs.ObjectColor(rhino_obj, y)
 
#back to gh
sc.doc = ghdoc
# ---------- end python_3 ----------
