# Grasshopper definition HexagridBoxMorphv240312.gh (Grasshopper 0.8.66)

geo = Geometry(<20, culture=neutral, publickeytoken=null referenced from the Rhino model>)
srf = Surface(<surface referenced from the Rhino model>)
bbox = BoundingBox(Content=geo, Union=True, Plane=PlaneXY(0, 0, 0))  # -> Box, Box_2
c_hexagridonsurface = CSharpScript(S=srf, Ex=Slider(23, range=1..36), Ey=Slider(20, range=1..25))  # -> out, C, SS; inputs S: Surface, Ex: Int32, Ey: Int32
# ---------- c_hexagridonsurface: C# ----------
    //Based on Rhinoscript code written and copyrighted by Ted Ngai Feb 2007
    //Ported to GH by Evert Amador
    //version 2012 March 25

    //We begin by performing a series of checks
    if(S == null) return;
    if(Ex == 0) return;
    if(Ey == 0) return;

    //We get the surface domain

    Rhino.Geometry.Interval DomainU = S.Domain(0);
    Rhino.Geometry.Interval DomainV = S.Domain(1);

    double stp = Math.PI / 3;
    int Hex_uCount = Ex;
    int Hex_vCount = Ey;

    double uLength = Hex_uCount * (3 * Math.Cos(stp)) + Math.Cos(stp);
    double vLength = Hex_vCount * (2 * Math.Sin(stp)) + Math.Sin(stp);
    double dUspacing = (DomainU.T1 - DomainU.T0) / (uLength);
    double dVspacing = (DomainV.T1 - DomainV.T0) / (vLength);

    //Instantiate a list of Breps to output as C
    DataTree<Brep> myS = new DataTree<Brep>();
    DataTree <Point3d> myPt = new DataTree<Point3d> ();

    for(int v = 0; v <= Hex_vCount - 1; v++)
    {
      GH_Path p = new GH_Path(v);

      for(int u = 0; u <= Hex_uCount - 1; u++)
      {
        myS.Add(SubSurface(S, u, v, stp, dUspacing, dVspacing), p);
        myPt.Add(CentrePoints(S, u, v, stp, dUspacing, dVspacing), p);
      }
    }

    myS.RenumberPaths("0, 0,{i}");
    myPt.RenumberPaths("0, 0,{i}");

    SS = myS;
    C = myPt;
# ---------- c_hexagridonsurface: C# additional code ----------
  Brep SubSurface (Surface S, int u, int v, double stp, double dUspacing, double dVspacing)
  {

    double xR, xL;
    double yT, yB;

    double dxR, dxL;
    double dyT, dyB;

    Point3d[] Pts = new Point3d[4];

    xR = u + u * Math.Cos(stp) + 2 * Math.Cos(stp) + Math.Cos(0);
    yT = (2 * v * Math.Sin(stp)) + (Math.Sin(stp) * (Math.Pow((0), (u % 2)))) + Math.Sin(stp) + Math.Sin(Math.PI / 3);
    xL = u + u * Math.Cos(stp) + 2 * Math.Cos(stp) + Math.Cos(Math.PI);
    yB = (2 * v * Math.Sin(stp)) + (Math.Sin(stp) * (Math.Pow((0), (u % 2)))) + Math.Sin(stp) - Math.Sin(2 * Math.PI / 3);


    dxR = xR * dUspacing;
    dyT = yT * dVspacing;
    dxL = xL * dUspacing;
    dyB = yB * dVspacing;

    // Top Right
    Pts[0] = S.PointAt(dxR, dyT);
    // Top Left
    Pts[1] = S.PointAt(dxL, dyT);
    //bottom Left
    Pts[2] = S.PointAt(dxL, dyB);
    //bottom right
    Pts[3] = S.PointAt(dxR, dyB);

    //4Point Surface
    Brep srf = Brep.CreateFromCornerPoints(Pts[0], Pts[1], Pts[2], Pts[3], 0.01);

    return srf;

  }

  Point3d CentrePoints (Surface S, int u, int v, double stp, double dUspacing, double dVspacing)
  {

    double x1;
    double y1;

    double px1;
    double py1;

    Point3d Pt = new Point3d();

    x1 = u + u * Math.Cos(stp) + 2 * Math.Cos(stp);
    y1 = (2 * v * Math.Sin(stp)) + (Math.Sin(stp) * (Math.Pow((0), (u % 2)))) + Math.Sin(stp);

    px1 = x1 * dUspacing;
    py1 = y1 * dVspacing;

    Pt = S.PointAt(px1, py1);
    
    return Pt;
  }
# ---------- end c_hexagridonsurface ----------
dom² = Domain²(UMin=0, UMax=1, VMin=0, VMax=1)
box = EvaluateBox(Box=bbox.Box_2, UParameter=0.5, VParameter=0.5, WParameter=0.5)  # -> Plane, Point, Include
sbox = SurfaceBox(Surface=reparameterize(c_hexagridonsurface.SS), Domain=dom², Height=Slider(0.1, range=0..1))
panel = Panel(c_hexagridonsurface.out)
morph = BoxMorph(Geometry=geo, Reference=bbox.Box_2, Target=sbox)
viewer = ParamViewer(c_hexagridonsurface.SS)
pt = Point(c_hexagridonsurface.C)
