# Grasshopper definition NumericalSolverGHforum.gh (Grasshopper 0.9.76)
# plug-ins: Python Interpreter

number_slider = Slider(360, range=0..360)
ellipse = Ellipse(Plane=PlaneXY(0, 0, 0), Radius1=Slider(100, range=0..100), Radius2=Slider(10, range=0..10))  # -> Ellipse, Focus1, Focus2
xy = XYPlane(Origin=Point(0, 0, 0))
rotate = Rotate(Geometry=ellipse.Ellipse, Angle=degrees(Slider(100, range=0..100)), Plane=PlaneXY(0, 0, 0))  # -> Geometry, Transform
rec = DataRecorder(number_slider, DataLimit=-10, RecordData=True)  # disabled
rotate_2 = Rotate(Geometry=xy, Angle=degrees(number_slider), Plane=PlaneXY(0, 0, 0))  # -> Geometry, Transform
bbox = BoundingBox(Content=rotate.Geometry, Plane=rotate_2.Geometry)  # -> Box, Box_2
panel = Panel(rec)
area = Area(Geometry=bbox.Box)  # -> Area, Centroid
panel_2 = Panel(area.Area)
bisection_wip = Bisection(x=number_slider, y=area.Area, pause=Toggle(True))  # -> out, a
# ---------- bisection_wip: Python ----------
# Imports
import Grasshopper as gh
import Rhino
import math
#import scriptcontext as sc


def ghComponentTimer(ghenv,pause,interval):
    
    #Update the component at the interval like using a GH timer
    
    # Ensure interval is larger than zero
    if interval <= 0:
        interval = 1
        
    # Get the Grasshopper document and component that owns this script
    ghComp = ghenv.Component
    ghDoc = ghComp.OnPingDocument()
    
    # Define the callback function
    def callBack(ghDoc):
        ghComp.ExpireSolution(False)
    # Update the solution
    if not pause:
        ghDoc.ScheduleSolution(interval,gh.Kernel.GH_Document.GH_ScheduleDelegate(callBack))

# Add the message thingie underneath the component
ghenv.Component.Name = "bisection"
ghenv.Component.NickName = 'bisection WIP' 
ghenv.Component.Message = "WIP" #sc.sticky['version']
ghObject = Rhino.RhinoApp.GetPlugInObject("Grasshopper")
def changeSlider(value, rangeA, rangeB):
    for input in ghenv.Component.Params.Input:
        for source in input.Sources:
            if type(source) is gh.Kernel.Special.GH_NumberSlider: #could also be used: if input.Name == "slider":
                guid = str(source.InstanceGuid)
                ghObject = Rhino.RhinoApp.GetPlugInObject("Grasshopper")
                ghObject.SetSliderRangeAndValue(guid, value, rangeA, rangeB)
                ############################################## Force refresh component inputs?! 
                ############################################## Force refresh component inputs?! 
                ############################################## Force refresh component inputs?!  


def bisection(f, a, b, TOL=0.001, NMAX=100):
    """
    Takes a function f, start values [a,b], tolerance value(optional) TOL and
    max number of iterations(optional) NMAX and returns the root of the equation
    using the bisection method.
    """
    n=1
    while n <= NMAX:
        c = (a+b)/2.0
        print "iter=%s\t\ta=%s\t\tb=%s\t\tc=%s\t\tf(c)=%s"%(n,round(a,2),round(b,2),round(c,2),f(c))
        if f(c)==0 or abs((b-a)/2.0) < TOL:
            print "\nx = %s"%c
            return c
        else:
            n = n+1
            if f(c)*f(a) > 0:
                a=c
            else:
                b=c
    return False

def func(x):
    changeSlider(x,0.0,360.0) #slider x
    
    print "slider value %d  area %d"%(x,y)
    return y
    
#Invoking Bisection Method
res = bisection(func,0,360)
# ---------- end bisection_wip ----------
