# Grasshopper definition Python_MeshEval.gh (Grasshopper 0.9.76)
# plug-ins: Python Interpreter

mplane = MeshPlane(Boundary={Plane=PlaneXY(0, 0, 0), Size=Domain2(u=-10..10, v=-10..10)}, WidthCount=6, HeightCount=6)  # -> Mesh, Area
mesh = Mesh(mplane.Mesh)

python = PythonScript(mesh=mesh)  # -> m_edges; inputs mesh: Mesh
# ---------- python: Python ----------
import Rhino as rc

m_edges = mesh.TopologyEdges
m_edges = [m_edges.EdgeLine(i) for i in range(m_edges.Count)]
# ---------- end python ----------
medges = MeshEdges(Mesh=mesh)  # -> NakedEdges, InteriorEdges, NonManifoldEdges

# ----
# Grasshopper version
curvepoint = PointOnCurve([medges.NakedEdges, medges.InteriorEdges], parameter=0.104)
# Doubleclick Me!
python_2 = PythonScript(x=python, y=mesh)  # -> out, a, b, c; inputs x: Curve, y: Mesh
# ---------- python_2: Python ----------
import rhinoscriptsyntax as rs
import Rhino.Geometry as rg
import Rhino as rc

pts = rg.Curve.PointAtNormalizedLength(x, 0.1)
a = linelength
b = pts
c = rg.Mesh.ClosestMeshPoint(y, b, 0)
# ---------- end python_2 ----------
meshcp = MeshClosestPoint(Point=curvepoint, Mesh=mesh)  # -> Point, Index, Parameter
# At the output it is necessary to obtain points on the grid and the normals at these points
# Output Point
# Output Normals
meval = MeshEval(Mesh=mesh, Parameter=meshcp.Parameter)  # -> Point, Normal, Colour
