# Grasshopper definition SampleProblem.gh (Grasshopper 0.8.52)

general_list = Panel("""4025443433,John Smith,123 N 5th St
4025334500,Jane Doe,4555 Columbia Ave
5124338990,Bob Shear,3422 West Maple St
2125004345,Bill Soof,8777 East Broadway
6885993568,Rob Sneally,900 W. Hillcrest St""")
code_for_method_2 = Panel("""a=len(y)

for i in range(a):
    y[i].split(",")
print y
a=y""")
code_for_method_1 = Panel("""a=len(y)
dict={}
for i in range(a):
    dict['list%i'%(i)]=y[1]
print dict
a=dict""")
# Method 1
python = PythonScript(Code=code_for_method_1, Y=general_list, GhMemory=-10)  # -> Output, A
# Desired Result
graft = GraftTree(Data=general_list, Strip=False)
# Method 2
python_2 = PythonScript(Code=code_for_method_2, Y=general_list, GhMemory=-10)  # -> Output, A
panel = Panel(python.A)
split = StringSplit(String=graft, Separators=",")
panel_2 = Panel(python_2.A)
desired_result = Panel(split)
