# Grasshopper definition SampleProblemN.gh (Grasshopper 0.9.14)
# plug-ins: Python Interpreter

# Remember!
# Python strings are immutable.
# An instance of a string cannot be
# modified by instance methods.
general_list = Panel("""4025443433,John Smith,123 N 5th St
4025334500,Jane Doe,4555 Columbia Ave
5124338990,Bob Shear,3422 West Maple St
2125004345,Bill Soof,8777 East Broadway
6885993568,Rob Sneally,900 W. Hillcrest St""")
# list access... why?
# if you really like to make
# your life more difficult :)
# Method 1
# item access.. easy :)
python = PythonScript(Code="a=y.split(\",\")", Y=general_list)  # -> Output, A
# Desired Result
graft = GraftTree(Data=general_list, Strip=False)
# Method 2
python_2 = PythonScript(y=general_list)  # -> out, a; inputs y: list
# ---------- python_2: Python ----------
from clr import AddReference as addr
addr("Grasshopper")

from System import Object
from Grasshopper import DataTree
from Grasshopper.Kernel.Data import GH_Path

a = DataTree[Object]()

for i in range(len(y)):
    p = GH_Path(i)
    a.AddRange(y[i].split(","), p)
# ---------- end python_2 ----------
panel = Panel(python.A)
split = StringSplit(String=graft, Separators=",")
panel_2 = Panel(python_2.a)
desired_result = Panel(split)
