# Grasshopper definition SetNamedSliders_GHPython_01.gh (Grasshopper 0.9.76)
# plug-ins: Python Interpreter

# ---- group: Set the Named Slider Values
panel = Panel("""0.1
0.75""")
panel_2 = Panel("""Foo
Bar""")
R = Reset(Sliders=panel_2, Values=panel, Toggle=Button())  # inputs Sliders: list, Values: list
# ---------- R: Python ----------
""" Reset named sliders """

import Grasshopper as gh

if Toggle:
    
    # Get to the GH objects
    ghObjects = ghenv.Component.OnPingDocument().Objects
    
    # Iterate the GH objects
    for obj in ghObjects:
        
        # Set the named slider values
        if obj.NickName in Sliders:
            if type(obj) is gh.Kernel.Special.GH_NumberSlider:
                obj.Slider.Value = Values[Sliders.index(obj.NickName)]
                obj.ExpireSolution(True)
# ---------- end R ----------

# ---- group: Slider not in list is not triggered
ham = Slider(0.8, range=0..1)

# ---- group: Some Named Slider
foo = Slider(0.1, range=0..1)
bar = Slider(0.75, range=0..1)

# ----
rec = DataRecorder(ham, DataLimit=-10, RecordData=True)
rec_2 = DataRecorder(bar, DataLimit=-10, RecordData=True)
rec_3 = DataRecorder(foo, DataLimit=-10, RecordData=True)
lng = ListLength(List=rec)
lng_2 = ListLength(List=rec_3)
lng_3 = ListLength(List=rec_2)
panel_3 = Panel([lng, lng_2, lng_3])
