# Grasshopper definition SimleRhinoCommonExample.gh (Grasshopper 0.9.14)
# plug-ins: Python Interpreter

python = PythonScript(x=Slider(84, range=0..100))  # -> out, pts; inputs x: Int32
# ---------- python: Python ----------
# Import RhinoCommon using the alias rc
import Rhino as rc

# Import the Python random module
import random

# Empty list to add points to
pts = []

# Simple loop for x times
for i in range(x):
    
    # Create a random point using RhinoCommon and random
    pt = rc.Geometry.Point3d(random.random(),random.random(),random.random())
    
    # Add this point to the empty list
    pts.append(pt)
# ---------- end python ----------
