# Grasshopper definition StairPython.gh (Grasshopper 0.9.76)
# plug-ins: Python Interpreter

# 2*h + L = step( len )
# step( default ) = 64 cm.
pipeline = GeometryPipeline(
    GroupByLayer=False,
    GroupByType=False,
    IncludeHidden=True,
    IncludeLocked=True,
    LayerFilter="0) Stairs",
    NameFilter="*",
    TypeFilter=5)
stair = PythonScript(Curves=pipeline, width=0, step=0)  # -> out, stairs, body; inputs Curves: list
# ---------- stair: Python ----------
import rhinoscriptsyntax as rs, copy
from Grasshopper import DataTree
from Grasshopper.Kernel.Data import GH_Path

"""Сделано Борисовым :)
Инструкция 
https://www.youtube.com/watch?v=5PcjGWjyHoE"""
# Ф У Н К Ц И И
def isplanar( crv ):
    return abs( rs.CurveStartPoint( crv )[2] - rs.CurveEndPoint( crv )[2] )
def isAngle( crv1, crv2 ):
    vector1 = rs.VectorCreate( rs.CurveStartPoint( crv1 ), rs.CurveEndPoint( crv1 ) )
    vector2 = rs.VectorCreate( rs.CurveStartPoint( crv2 ), rs.CurveEndPoint( crv2 ) )
    return not 45 < rs.VectorAngle( vector1, vector2 ) < 135

# К Л А С С Ы
#Базовый
class BaseStair :
    """ Принмает планарную поверхность, обозначающую лестницу и точку выосты лестницы 
        Высота точки от поверхности обозначает высоту лестницы, а положение точки
        - направление подъема. Направляющие поверхности буду ступенями                """
    def __init__( self, surface, point ):
        self.surface = surface
        self.point = point
        self.preparation( )
    
    def preparation( self ):
        self.sDirection( self.surface, self.point )
        UV = rs.SurfaceParameter( self.surface, (0, 0.5))
        self.plane = rs.SurfaceFrame( self.surface, UV )
        self.os = rs.ExtractIsoCurve( self.surface, UV, 0 )
        #rs.ReverseCurve( self.os )
        #Числовые параметры
        self.height = abs( rs.DistanceToPlane( self.plane, self.point ) )
        self.len = rs.CurveLength( self.os )
        self.nofSteps = int(( 2 * self.height + self.len ) / _step)
        self.stepHeight = self.height / self.nofSteps
        self.stepsZ = [ (i+1) * self.stepHeight for i in range( self.nofSteps ) ]
        self.xForms = [ rs.XformTranslation( (0, 0, i) ) for i in self.stepsZ ]
        self.parametrs = list( reversed( rs.DivideCurve( self.os, self.nofSteps, False, False ) ) )
    
    def __call__( self, depth = 0.1 ):
        parametrs = list( self.parametrs )
        splitParam = zip( parametrs[:-1], parametrs[1:] )
        levels = [ rs.TrimSurface( self.surface, 0, i ) for i in splitParam ]
        map( rs.TransformObject, levels, self.xForms )
        
        self.levels = map( rs.coercesurface, levels )
        self.body = levels
        self.os = rs.coercecurve( self.os )
        self.surface = rs.coercesurface( self.surface )
        return levels
    
    def sDirection( self, surf, point ):
        #Точка на поверхности
        UV = rs.SurfaceClosestPoint( surf, point )
        #Нормализованый параметр
        normU, normV = rs.SurfaceNormalizedParameter( surf, UV)
        U, V = abs( normU - 0.5 ), abs( normV - 0.5 )
        #Меняем стороны местами
        if U < V:
            rs.ReverseSurface( surf, 4 )
            if normV > 0.5:
                rs.ReverseSurface( surf, 1 )
            if sum( rs.SurfaceDomain( surf, 0 )) < 0:
                rs.ReverseSurface( surf, 2 )
        #Не меняем
        else:
            if normU > 0.5:
                rs.ReverseSurface( surf, 1 )
            if sum( rs.SurfaceDomain( surf, 0 )) > 0:
                rs.ReverseSurface( surf, 2 )
#Производные
class StairByCurve( BaseStair ):
    """ Создает лестницу по одной линии """
    def __init__( self, osCurve, width = 2 ):
        pointS = rs.CurveStartPoint( osCurve )
        pointE = rs.CurveEndPoint( osCurve )
        self.point, pointDown = (pointS, pointE) if pointS[2] > pointE[2] else (pointE, pointS)
        plane = rs.PlaneFromFrame( pointDown, (1,0,0), (0,1,0) )
        xform = rs.XformPlanarProjection( plane )
        rs.TransformObject( osCurve, xform )
        crv1 = rs.OffsetCurve( osCurve, plane[0], width/2 )
        crv2 = rs.OffsetCurve( osCurve, plane[0], -width/2 )
        self.surface = rs.AddEdgeSrf(( crv1, crv2 ))
        self.preparation( )
class SteirByEdges( BaseStair ):
    """ создает лестницу по трем или четырем ограничивающим линиям """
    def __init__( self, edges ):
        crvs = sorted( edges, key = isplanar )
        self.upEdge, self.downEdge = crvs[:2]
        self.point, downpoin = map( rs.CurveMidPoint, crvs[:2] )
        if self.point[2] < downpoin[2]:
            self.point, downpoin = downpoin, self.point
            self.downEdge, self.upEdge = self.upEdge, self.downEdge
        plane = rs.PlaneFromFrame( downpoin, (1,0,0), (0,1,0) )
        xform = rs.XformPlanarProjection( plane )
        curves = rs.TransformObjects( edges, xform, True )
        self.surface = rs.AddEdgeSrf( curves )
        self.preparation( )
class SteirByAxis( BaseStair ):
    def __init__( self, axis, *edges ):
        
        #Определение верхней и нижней точки
        pointStart = rs.CurveStartPoint( axis )
        poinEnd = rs.CurveEndPoint( axis )
        bol = pointStart[2] > poinEnd[2]
        self.point, downPoint = (pointStart, poinEnd) if bol else (poinEnd, pointStart)
        for i in edges: 
            if rs.IsPointOnCurve( i, self.point ):
                if rs.IsCurvePlanar( i ):
                    self.upEdge = i
            if rs.IsPointOnCurve( i, downPoint ):
                if rs.IsCurvePlanar( i ):
                    self.downEdge = i
        #Проецирование на плоскость нижней точки
        xform = rs.XformPlanarProjection( rs.PlaneFromFrame( downPoint, (1,0,0), (0,1,0) ))
        rs.TransformObject( axis, xform )
        edges = rs.TransformObjects( edges, xform, copy = True )
        
        t1, t2 = rs.CurveDomain( axis )
        
        #Влияющие точки
        allPoints = []
        allPoints += map( rs.CurveEndPoint, edges ) 
        allPoints += map( rs.CurveStartPoint, edges )
        tParams = [ rs.CurveClosestPoint( axis, i ) for i in allPoints ]
        perpPlanes = [ rs.CurvePerpFrame( axis, i ) for i in tParams ]
        planes = [ rs.PlaneFromNormal( i[0], (0,0,1), i[3] ) for i in perpPlanes ]
        xyValues = map( rs.XformWorldToCPlane, allPoints, planes )
        
        #Удлинение
        if t1 in tParams:
            inEnd = min( i[0] for i in xyValues )
            rs.ExtendCurveLength( axis, 0, 0, abs( inEnd ))
        if t2 in tParams > 0 :
            inStart = max( i[0] for i in xyValues )
            rs.ExtendCurveLength( axis, 0, 1, inStart )
        
        #Оффсет
        plane = planes[0]
        orientPoint = rs.EvaluatePlane( plane, (0,1) )
        lVal = max( i[1] for i in xyValues )
        edgeL = rs.OffsetCurve( axis, orientPoint, lVal * 1.01, (0,0,1), 1 )[0]
        rVal = min( i[1] for i in xyValues )
        edgeR = rs.OffsetCurve( axis, orientPoint, rVal * 1.01, (0,0,1), 1 )[0]
        
        #Базовая поверхность
        baseSurface = rs.AddEdgeSrf( (edgeR, edgeL) )
        pointsL = [ i for i, j in zip( allPoints, xyValues ) if j[1] > 0 ]
        pointsR  = [ i for i, j in zip( allPoints, xyValues ) if j[1] < 0 ]
        
        #Если всего одна грань
        if len( edges ) < 2:
            if rs.IsPointOnCurve( edges[0], rs.CurveEndPoint( axis ) ): t1, t2 = t2, t1
            plane = rs.CurvePerpFrame( axis, t2 )
            plane = rs.PlaneFromNormal( plane[0], (0,0,1), plane[3] )
            pointsL.append( rs.EvaluatePlane( plane, (0, max( i[1] for i in xyValues ))))
            pointsR.append( rs.EvaluatePlane( plane, (0, min( i[1] for i in xyValues ))))
        
        #Итоговая поверхность
        edgeLeft = rs.AddInterpCrvOnSrf( baseSurface, pointsL )
        edgeRight = rs.AddInterpCrvOnSrf( baseSurface, pointsR )
        self.surface = rs.AddEdgeSrf( list( edges ) + [edgeLeft, edgeRight] )
        
        self.preparation( )


_step = step or 0.64
_width = width or 1.5
_crvs = Curves
_stepH = 0.4
curveSet = set( Curves )

stairs = []

# ПО 3-м ИЛИ 4-м ОГРАНИЧИВАЮШИМ ЛИНИЯМ
for i in rs.JoinCurves( _crvs ) if len( _crvs ) > 1 else _crvs:
    crvL = []
    for j in _crvs:
        if rs.IsPointOnCurve( i, rs.CurveMidPoint( j ) ):
            crvL.append( j )
    if len( crvL ) > 2:
        curveSet -= set( crvL )
        if len( crvL ) < 4: crvL.append( rs.AddLine( rs.CurveStartPoint( i ), rs.CurveEndPoint( i ) ) )
        stairs.append( SteirByEdges( crvL ) )

# ЦЕНТРАЛЬНАЯ ОСЬ И 2 ИЛИ 1 ЗАКЛЮЧИТЕЛЬНЫЕ ЛИНИИ
for i in filter( isplanar, curveSet ):
    crvs = []
    point1 = rs.CurveStartPoint( i )
    point2 = rs.CurveEndPoint( i )
    for j in curveSet:
        if j is not i and (rs.IsPointOnCurve( j, point1 ) or rs.IsPointOnCurve( j, point2 )):
            crvs.append( j )
    if crvs :
        curveSet -= set( [i] )
        curveSet -= set( crvs )
        try:
            stairs.append( SteirByAxis( i, *crvs ) )
        except:
            pass

# ПО ОДНОЙ ЦЕНТРАЛЬНОЙ ЛИНИИ
os = [ j for j in curveSet if isplanar( j ) > _stepH ]
curveSet -= set( os )
for i in os:
    stairs.append( StairByCurve( i, _width ) )

# ПО ДВУМ КРАЙНИМ ЛИНИЯМ
curveH = { i:rs.CurveMidPoint( i )[2] for i in curveSet }
while True:
    try:
        i, h = curveH.popitem()
    except KeyError:
        break
    crvs = [ l for l, j in curveH.items() if abs( h - j ) > _stepH ]
    crvs = [ m for m in crvs if isAngle( i, m ) ]
    if crvs:
        crv1, point1, point2 = rs.CurveClosestObject( i, crvs )
        dist1 = rs.Distance( point1, point2 )
        crvs = [ l for l, j in curveH.items() if abs( curveH[crv1] - j ) > _stepH ]
        crvs = [ m for m in crvs if isAngle( crv1, m ) ]
        if crvs :
            crv2, point1, point2 = rs.CurveClosestObject( crv1, crvs )
            dist2 = rs.Distance( point1, point2 )
            if dist1 > dist2: continue
        stairs.append( SteirByEdges( (i, crv1) ) )
        curveH.pop( crv1 )


body = DataTree[ object ]()
for n, s in enumerate( stairs ):
    body.AddRange( s(  ), GH_Path( n ))
# ---------- end stair ----------
number_slider = Slider(0.931, range=0..2)
hard = PythonScript(Stairs=stair.stairs, thickness=Slider(0, range=0..3))  # -> out, stairs, body; inputs Stairs: list
# ---------- hard: Python ----------
import rhinoscriptsyntax as rs, scriptcontext as sc

def call( self, thickness = 0 ):
    thickness = _thickness
    surface = self.surface
    height = self.height
   #Получение линий для ступеней
    curves = [ rs.ExtractIsoCurve( surface, ( i, 0 ), 1 )[0] for i in self.parametrs ]
    
   #Кривые линии ступеней
    xForms = self.xForms
    bols = map( bool, xForms )
    L1 = curves[:2]+map( rs.TransformObject, curves[2:-1], xForms[:-2], bols[:-2] )
    L2 = map( rs.TransformObject, curves[:-1], xForms, bols )
    L3 = map( rs.TransformObject, curves[1:], xForms, bols )
    L4 = curves[1:2] + map( rs.TransformObject, curves[2:], xForms[:-1], bols[:-1] )
    #Попытка замены
    try:
        if not rs.CurveDirectionsMatch( L3[-1], self.upEdge ): rs.ReverseCurve( self.upEdge )
        L3[-1] = self.upEdge
    except:
        pass
    try:
        if not rs.CurveDirectionsMatch( L1[0], self.downEdge ): rs.ReverseCurve( self.downEdge )
        L1[0] = self.downEdge
    except:
        pass
    xf = rs.XformTranslation( (0,0,-thickness) )
    rs.TransformObjects( L1, xf )
    rs.TransformObjects( L4[1:], xf )
   #Получение ограничивающих поверхностей
    xfrm = rs.XformTranslation( (0,0,- thickness - 1) )
    parametr = rs.SurfaceParameter( surface, (0.5, 0) )
    curve = rs.ExtractIsoCurve( surface, parametr, 0 )
    rs.TransformObject( curve, xfrm )
    bondary0 = rs.ExtrudeCurveStraight( curve, (0,0,0), (0,0,height+thickness+2) )
    parametr = rs.SurfaceParameter( surface, (0.5, 1) )
    curve = rs.ExtractIsoCurve( surface, parametr, 0 )
    rs.TransformObject( curve, xfrm )
    bondary1 = rs.ExtrudeCurveStraight( curve, (0,0,0), (0,0,height+thickness+2) )
    
   #Боковушки
    Ls1 = zip( L1, L4 )
    Ls2 = zip( L2, L3 )
    G00 = [ rs.AddInterpCrvOnSrf( bondary1, map( rs.CurveEndPoint, i )) for i in Ls1 ]
    G01 = [ rs.AddInterpCrvOnSrf( bondary1, map( rs.CurveEndPoint, i )) for i in Ls2 ]
    Eges1 = map( rs.AddEdgeSrf, zip( G00, G01 ) )
    G10 = [ rs.AddInterpCrvOnSrf( bondary0, map( rs.CurveStartPoint, i )) for i in Ls1 ]
    G11 = [ rs.AddInterpCrvOnSrf( bondary0, map( rs.CurveStartPoint, i )) for i in Ls2 ]
    Eges0 = map( rs.AddEdgeSrf, zip( G10, G11 ) )
    
   #Поперечные
    C0 = zip( L1, G00, L4, G10 )
    EgesDown = map( rs.AddEdgeSrf, C0 )
    C1 = zip( L2, G01, L3, G11 )
    EgesUp = map( rs.AddEdgeSrf, C1 )
    Ls3 = zip( L2+[L4[-1]], [L1[0]]+L3 )
    EgesFront = map( rs.AddEdgeSrf, Ls3 )
    
   #Тело
    Body = rs.JoinSurfaces( EgesUp+ EgesDown+ EgesFront+ Eges0+ Eges1 )
    
    self.levels = map( rs.coercesurface, EgesUp )
    self.body = Body
    
    return Body

_thickness = thickness or 0

body = map( call, Stairs )
stairs = Stairs

print 'ok'
# ---------- end hard ----------
basic = PythonScript()  # -> out, stairs, body; inputs Stairs: list
# ---------- basic: Python ----------
import rhinoscriptsyntax as rs, scriptcontext as sc
from Grasshopper import DataTree
from Grasshopper.Kernel.Data import GH_Path

def call( self, depth = 0, param = 0 ):
    surface = self.surface
    parametrs = self.parametrs
    parametrs2 = [ x + ((y - x) * param) for x, y in zip( parametrs[1:-1], parametrs[2:] ) ]
    parametrs2.append( parametrs[-1] )
    splitParam = zip( parametrs[:-1], parametrs2 )
    splitSurf = [ rs.TrimSurface( surface, 0, i ) for i in splitParam ]
    map( rs.TransformObject, splitSurf, self.xForms )
    line = rs.AddLine( (0,0,0), (0,0,(-self.stepHeight - depth)) )
    body = [ rs.ExtrudeSurface( i, line ) for i in splitSurf ]
    return body

_depth = depth or 0
_inside = inside or 0.3

body = DataTree[ object ]()
for n, s in enumerate( Stairs ):
    body.AddRange( call( s, _depth, _inside ), GH_Path( n ))
stairs = Stairs
# ---------- end basic ----------
basic2 = PythonScript()  # -> out, stairs, body; inputs Stairs: list
# ---------- basic2: Python ----------
import rhinoscriptsyntax as rs, scriptcontext as sc
from Grasshopper import DataTree
from Grasshopper.Kernel.Data import GH_Path

def call( self, depth = 0, param = 0 ):
    surface = self.surface
    parametrs = self.parametrs
    splitParam = zip( parametrs[:-1], parametrs[1:] )
    splitSurf = [ rs.TrimSurface( surface, 0, i ) for i in splitParam ]
    lines = [ rs.AddLine( (0,0,0), (0,0,i) ) for i in self.stepsZ ]
    body = map( rs.ExtrudeSurface, splitSurf, lines )
    return body


body = DataTree[ object ]()
for n, s in enumerate( Stairs ):
    body.AddRange( call( s ), GH_Path( n ))
stairs = Stairs
# ---------- end basic2 ----------
rail = PythonScript(Stairs=hard.stairs, railHeight=number_slider, railOffset=Slider(0.063, range=-0.5..1), railPosit=Slider(0.5, range=0..1))  # -> out, railL, planesL, railR, planesR; inputs Stairs: list
# ---------- rail: Python ----------
import rhinoscriptsyntax as rs, scriptcontext as sc
from Grasshopper import DataTree
from Grasshopper.Kernel.Data import GH_Path

def railPlanes( self, offset = 0.05, t = 0.5 ):
    surface = sc.doc.Objects.AddSurface( self.surface )
    d0, d1 = rs.SurfaceDomain( surface, 1 )
    line = rs.AddLine((0,0,0), (0,0,self.height))
    xfrm = rs.XformTranslation( (0,0,railHeight) )
    parametrs = [ i + ( (j - i)*t) for i, j in zip( self.parametrs[:-1], self.parametrs[1:] ) ]
    curves = [ rs.ExtractIsoCurve( surface, (i, 0), 1 )[0] for i in parametrs]
    for i in curves:
        rs.ExtendCurveLength( i, 0, 2, offset )
   #Правые
    Curve = rs.ExtractIsoCurve( surface, (0, d0), 0 )
    RPlanes =[]
    points = []
    for p in reversed( parametrs ):
        C = rs.ExtractIsoCurve( surface, (p, 0), 1 )[0]
        if offset: rs.ExtendCurveLength( C, 0, 0, offset )
        perpPlane = rs.CurvePerpFrame( Curve, p )
        point = rs.CurveStartPoint( C )
        plane = rs.PlaneFromNormal( point, (0,0,1), rs.VectorReverse( perpPlane[1] ) )
        points.append( point )
        RPlanes.append( plane )
    RPlanes = map( rs.PlaneTransform, RPlanes, self.xForms[::-1] )
   #Перила
    uv = ( rs.SurfaceClosestPoint( surface, i ) for i in points )
    points = [ rs.EvaluateSurface( surface, *i ) for i in uv ]
    segments = [ rs.AddInterpCrvOnSrf( surface, i ) for i in zip( points[:-1], points[1:]) ]
    curve = rs.JoinCurves( segments )
    base = rs.ExtrudeCurve( curve, line )
    points = map( rs.PointTransform, points, self.xForms[::-1] )
    railR = rs.AddInterpCrvOnSrf( base, points) 
    rs.TransformObject( railR, xfrm )
   #Левые
    Curve = rs.ExtractIsoCurve( surface, (0, d1), 0 )
    LPlanes =[]
    points = []
    for p in reversed( parametrs ):
        C = rs.ExtractIsoCurve( surface, (p, 0), 1 )[0]
        if offset: rs.ExtendCurveLength( C, 0, 1, offset )
        perpPlane = rs.CurvePerpFrame( Curve, p )
        point = rs.CurveEndPoint( C )
        plane = rs.PlaneFromNormal( point, (0,0,1), rs.VectorReverse( perpPlane[1] ) )
        points.append( point )
        LPlanes.append( plane )
    LPlanes = map( rs.PlaneTransform, LPlanes, self.xForms[::-1] )
   #Перила
    uv = ( rs.SurfaceClosestPoint( surface, i ) for i in points )
    points = [ rs.EvaluateSurface( surface, *i ) for i in uv ]
    segments = [ rs.AddInterpCrvOnSrf( surface, i ) for i in zip( points[:-1], points[1:]) ]
    curve = rs.JoinCurves( segments )
    base = rs.ExtrudeCurve( curve, line )
    points = map( rs.PointTransform, points, self.xForms[::-1] )
    railL = rs.AddInterpCrvOnSrf( base, points) 
    rs.TransformObject( railL, xfrm )
    return railR, RPlanes, railL, LPlanes

railL = DataTree[ object ]()
planesL = DataTree[ object ]()
railR = DataTree[ object ]()
planesR = DataTree[ object ]()

for n, s in enumerate( Stairs ):
    rr, pr, rl, pl = railPlanes( s, -railOffset, railPosit )
    railR.AddRange( [rr], GH_Path( n ))
    railL.AddRange( [rl], GH_Path( n ))
    planesR.AddRange( pr, GH_Path( n ))
    planesL.AddRange( pl, GH_Path( n ))


#a = railPlanes( Stairs[2], -railOffset, railPosit )
# ---------- end rail ----------
steps = PythonScript(Stairs=hard.stairs, depth=0.04, front=0.05, laterally=0)  # -> out, steps; inputs Stairs: list
# ---------- steps: Python ----------
import rhinoscriptsyntax as rs, scriptcontext as sc
from Grasshopper import DataTree
from Grasshopper.Kernel.Data import GH_Path


def stairSteps( self, extrude = 0.1, front = 0.1, around = 0 ):
    os = sc.doc.Objects.AddCurve( self.os )
    levels = map( sc.doc.Objects.AddSurface, self.levels )
    around = around or front
    points = rs.DivideCurve( os, self.nofSteps, True, True )
    points = map( rs.PointTransform, reversed( points[:-1] ), self.xForms )
    map( self.sDirection, levels, points )
    for i in levels:
        uv =  rs.SurfaceParameter( i, (1, 0.5) )
        rs.ExtendSurface( i, uv, front )
        uv =  rs.SurfaceParameter( i, (0.5, 0) )
        rs.ExtendSurface( i, uv, around )
        uv =  rs.SurfaceParameter( i, (0.5, 1) )
        rs.ExtendSurface( i, uv, around )
    line = rs.AddLine( (0,0,extrude), (0,0,0) )
    steps = [ rs.ExtrudeSurface( i, line ) for i in levels]
    xform = rs.XformTranslation( (0,0,-extrude) )
    rs.TransformObject( self.body, xform )
    return steps

steps = DataTree[ object ]()
for n, i in enumerate( Stairs ):
    steps.AddRange( stairSteps( i, depth, front, laterally ), GH_Path( n ))
# ---------- end steps ----------
# instruction
# https://www.youtube.com/watch?v=5PcjGWjyHoE
preview = CustomPreview(Geometry=flatten([basic.body, basic2.body, hard.body]), Shader=ColourSwatch(SwatchColor=RGB(125, 125, 125)))
preview_2 = CustomPreview(Geometry=flatten(steps.steps), Shader=ColourSwatch(SwatchColor=RGB(92, 74, 39)))

радиус = Slider(0.035, range=0..0.1)
радиус_2 = Slider(0.01, range=0..0.1)
радиус_3 = Slider(0.025, range=0..0.1)
вылет = Slider(0.3, range=0..0.4)
crv = Curve(flatten([rail.railL, rail.railR]))
pln = Plane(flatten([rail.planesL, rail.planesR]))
num = Number(number_slider)
ext = ExtendCurve(Curve=crv, Type=0, Start=вылет, End=вылет)
neg = Negative(Value=радиус_2)
end = EndPoints(Curve=ext)  # -> Start, End
dom = ConstructDomain(DomainStart=радиус_2, DomainEnd=neg)
sph = Sphere(Base=[end.Start, end.End], Radius=радиус)
pipe = Pipe(Curve=ext, Radius=радиус_3, Caps=0)
box = DomainBox(Base=pln, X=dom, Y=dom, Z=num)
preview_3 = CustomPreview(Geometry=flatten([sph, pipe, box]), Shader=ColourSwatch(SwatchColor=RGB(28, 28, 28)))
