# Grasshopper definition dataTree.gh (Grasshopper 0.9.76)
# Copyright: WeKen Lam
# plug-ins: Python Interpreter

series = Series(Start=0, Step=1, Count=10)

# ---- group: c is a dataTree
python = PythonScript(x=series, y=Slider(4, range=0..10))  # -> out, a, b, c; inputs x: list
# ---------- python: Python ----------
import itertools
import Grasshopper
import System
import Grasshopper.Kernel.Data.GH_Path as ghpath

a =  list(itertools.combinations(x, y))
b = []
c = []
dat = Grasshopper.DataTree[System.Object]()
for x,y in enumerate(a):
    p = ghpath(7,x)
    for i in y:
        dat.Add(i,p)
        b.append(p)

c=dat
# ---------- end python ----------

# ----
graft = GraftTree(Tree=python.a, IncludeEmptyLists=True, IncludeNullItems=True)
python_2 = PythonScript(x=graft)  # -> out, a
# ---------- python_2: Python ----------
a =x
# ---------- end python_2 ----------
panel = Panel(python.c)
python_3 = PythonScript(x=python_2.a)  # -> out, a; inputs x: tree
# ---------- python_3: Python ----------
import Grasshopper

x.SimplifyPaths()
a=x
# ---------- end python_3 ----------

# ---- group: c is same
python_4 = PythonScript(x=python_2.a, y=python.c)  # -> out, a, b, c; inputs x: tree, y: tree
# ---------- python_4: Python ----------
import Grasshopper
import System

a = y.Paths
b = x.Paths

dat = Grasshopper.DataTree[System.Object]()
if len(a) == len(b):
    for i in range(x.BranchCount-1):
        dat.AddRange(x.Branch(i),a[i])

c = dat
# ---------- end python_4 ----------
match = MatchTree(Tree=python_2.a, Guide=python.c)

# ----
panel_2 = Panel(python_4.c)
panel_3 = Panel(python_4.b)
panel_4 = Panel(match)
