# Grasshopper definition layer_tree_add_range.ghx (Grasshopper 0.8.66)

hexgrid = Hexagonal(Plane=PlaneXY(0, 0, 0), Size=1, ExtentX=5, ExtentY=5)  # -> Cells, Points
pt = Point(flatten(hexgrid.Points))
python = PythonScript(points=pt, GhMemory=0)  # -> out, a; inputs points: list of GeometryBase
# ---------- python: Python ----------
import Rhino
import scriptcontext


# for accesssing GH classes
import clr
clr.AddReference("Grasshopper")
from Grasshopper.Kernel.Data import GH_Path
from Grasshopper import DataTree


layerTree = DataTree[Rhino.Geometry.GeometryBase]() # make a DataTree
for i in range(len(points)):
    point = points[i]
    path = GH_Path(i)
    layerTree.AddRange([point], path)
a = layerTree
# ---------- end python ----------
panel = Panel(python.a)
