# Grasshopper definition layer_tree_add_rangeN.gh (Grasshopper 0.9.14)
# plug-ins: Python Interpreter

panel = Panel("""Layer 01
Layer 02""")
python = PythonScript(layernames=panel)  # -> out, a; inputs layernames: list
# ---------- python: Python ----------
import Rhino
import scriptcontext

#we need to switch script context to use Rhino (Grasshopper has no knowledge of layers)
scriptcontext.doc = Rhino.RhinoDoc.ActiveDoc


# for accesssing GH classes
import clr
clr.AddReference("Grasshopper")
from Grasshopper.Kernel.Data import GH_Path
from Grasshopper import DataTree


layerTree = DataTree[Rhino.Geometry.GeometryBase]() # make a DataTree
for i in range(len(layernames)):
    
    objs = scriptcontext.doc.Objects.FindByLayer(layernames[i])
    
    if objs:
        geoms = [obj.Geometry for obj in objs]
        path = GH_Path(i)
        
        layerTree.AddRange(geoms, path)

a = layerTree
# ---------- end python ----------
panel_2 = Panel(python.a)
