# Grasshopper definition least_cost_path.ghx (Grasshopper 0.9.76)
# plug-ins: Python Interpreter

# http://www.grasshopper3d.com/forum/topics/least-cost-path-on-mesh-python
slider = Slider(33, range=0..100)
trigrid = Triangular(Plane=PlaneXY(0, 0, 0), Size=1, ExtentX=slider, ExtentY=Slider(19, range=0..100))  # -> Cells, Points
cp = ControlPoints(Curve=trigrid.Cells)  # -> Points, Weights, Knots
shift = ShiftList(List=cp.Points, Shift=1, Wrap=False)
cset = CreateSet(List=flatten(shift))
lng = ListLength(List=cset)
subtraction = Subtraction(A=lng, B=1)
range = Range(Domain=Domain(0, 1), Steps=subtraction)
graph = GraphMapper(
    range,
    x0=0,
    x1=1,
    y0=0,
    y1=1,
    amplitude=0.9386667721,
    container_name="Perlin",
    decay=0.2063187361,
    frequency=0.2924061716,
    x_offset=0.6766392589,
    y_offset=0.4363473952)
jitter = Jitter(List=graph, Jitter=Slider(0.178, range=0..1), Seed=2)  # -> Range, Indices
Z = UnitZ(Factor=jitter.Range)
domain = Domain(subtraction)
move = Move(Geometry=cset, Translation=Z)  # -> Geometry, Transform
remap = RemapNumbers(
    Values=[Slider(0.107, range=0..1), Slider(0.891, range=0..1), Slider(0.179, range=0..1), Slider(0.732, range=0..1)],
    Source=Domain(0, 1),
    Target=domain)
split = SplitList(List=remap, Index=1)  # -> ListA, ListB
con = DelaunayEdges(Points=move.Geometry, Plane=PlaneXY(0, 0, 0))  # -> Connectivity, Edges
del = DelaunayMesh(Points=move.Geometry, Plane=PlaneXY(0, 0, 0))
item = ListItem(List=move.Geometry, Index=remap, Wrap=False)
preview = CustomPreview(
    Geometry=flatten([del, con.Edges]),
    Shader=[ColourSwatch(SwatchColor=RGB(130, 130, 130)), ColourSwatch(SwatchColor=RGB(107, 107, 107))])
flatness_bias = Slider(1, range=0..1)
slider_2 = Slider(0.25, range=0..1)
python = PythonScript(mesh=del, from_node=split.ListA, to_node=split.ListB, flatness_bias=flatness_bias, GhMemory=0)  # -> out, a; inputs mesh: Mesh, from_node: Int32, to_node: Int32, flatness_bias: Double
# ---------- python: Python ----------
import sys
import os

import Rhino

pathbits = [
        'C:\\Program Files (x86)',
        'Python26',
        'Lib',
        'site-packages'
        ]

importPath = os.path.join(*pathbits)
sys.path.append( importPath )

import networkx

G = networkx.Graph()
G.add_nodes_from(range(mesh.Vertices.Count))

def weight_function(i, j):
    p1 = Rhino.Geometry.Point3d((mesh.TopologyVertices[i]))
    p2 = Rhino.Geometry.Point3d((mesh.TopologyVertices[j]))
    base_weight = p1.DistanceTo(p2)
    deltaZ = p2.Z - p1.Z
    if deltaZ < 0.0:
        deltaZ *= -1
    return base_weight * (deltaZ ** flatness_bias)

for i in range(mesh.TopologyEdges.Count):
    pair = mesh.TopologyEdges.GetTopologyVertices(i)
    G.add_edge(pair.I, pair.J)
    weight = weight_function( pair.I, pair.J )
    G[pair.I][pair.J]['weight'] = weight

from_v = mesh.TopologyVertices.TopologyVertexIndex(from_node)
to_v = mesh.TopologyVertices.TopologyVertexIndex(to_node)

topology_list = networkx.algorithms.shortest_paths.generic.shortest_path(G, from_v, to_v, True)

a = [Rhino.Geometry.Point3d(mesh.TopologyVertices[v]) for v in topology_list]
# ---------- end python ----------
pline = PolyLine(Vertices=python.a, Closed=False)
preview_2 = CustomPreview(Geometry=flatten([pline, item]), Shader=ColourSwatch(SwatchColor=RGB(255, 0, 255)))
