# Grasshopper definition pythonListtoTree(1).gh (Grasshopper 0.9.65)
# plug-ins: Python Interpreter

python = PythonScript()  # -> out, a
# ---------- python: Python ----------
list = [1,[2,3],[1,[10,11,12],3],[1,2,3],[1,2,3]]
print list
a = list
# ---------- end python ----------
panel = Panel(python.out)
pylist2tree = PythonListToGHTree(list=python.a)  # -> out, tree_out; inputs list: list
# ---------- pylist2tree: Python ----------
import collections
from Grasshopper import DataTree
from Grasshopper.Kernel.Data import GH_Path
from Grasshopper.Kernel import GH_Author

ghenv.Component.Name = 'python list to GH tree'
ghenv.Component.NickName = 'pyList2Tree'



"""
Python List to Grasshopper Tree - Component
by Andrei Nejur 

takes a nested python list an outputs the corespnding GH Tree with
each list element on its coresponding branch. Works with as many nested 
levels as needed.
Just plug the nested python list in the list input. 
Out prints a list of the created tree branches .


Use it for whatever you need 
"""


def unpackList(lst, path=GH_Path(0)):
    tree = DataTree[object]()
    
    for elem in lst:
        
        if isinstance(elem, collections.Iterable):
            tree.MergeTree(unpackList(elem,path.AppendElement(0)))
        else:
            print(path)
            tree.Add(elem,path)
        path = path.Increment(-1)
    return tree



tree_out = unpackList(list)
# ---------- end pylist2tree ----------
panel_2 = Panel(pylist2tree.out)
viewer = ParamViewer(pylist2tree.tree_out)
panel_3 = Panel(pylist2tree.tree_out)
