# Grasshopper definition vd_test_trim.gh (Grasshopper 0.9.75)
# plug-ins: Python Interpreter

crv = Curve(<curve referenced from the Rhino model>)
python = PythonScript(boundary=crv)  # -> out, a; inputs boundary: Curve
# ---------- python: Python ----------
import ghpythonlib.components as ghc
import rhinoscriptsyntax as rs
import Rhino.Geometry as rg
import random as rm

objs = []

points = []
for i in range(10):
    x = rm.uniform(0,146)
    y = rm.uniform(0,90)
    point = rg.Point3d(x,y,0)
    points.append(point)

vd = ghc.Voronoi(points)#,100,boundary)
bd = boundary

#sp = rs.CurveBooleanIntersection(vd,bd)
#print sp
newcells = []
for cell in vd:
    #sp = rs.SplitCurve(cell, bd)
    sp = rs.CurveBooleanIntersection(cell,bd)
    print sp
    #newsells.append(sp)
    objs.extend(sp)
    
#objs.extend(vd)
a = objs
# ---------- end python ----------
