# Grasshopper definition 物件存储位置转换.gh (Grasshopper 0.9.76)
# plug-ins: Python Interpreter, LunchBox

point = Point([Point(-355.0609969, -154.7649962, 0), Point(-151.2445051, -12.30446774, 0), Point(-207.5312314, -46.69379011, 0), Point(-288.2673246, 25.2097112, 0), Point(-254.0270629, -16.04891797, 0)])
point_2 = Point([Point(-355.0609969, -154.7649962, 0), Point(-151.2445051, -12.30446774, 0), Point(-207.5312314, -46.69379011, 0), Point(-288.2673246, 25.2097112, 0), Point(-254.0270629, -16.04891797, 0)])
python_script = PythonScript(x=point_2)  # -> out, a, b; inputs x: list of Point3d
# ---------- python_script: Python ----------
import rhinoscriptsyntax as rs
import scriptcontext as sc
import Rhino

#go rhino
sc.doc = Rhino.RhinoDoc.ActiveDoc
a=rs.AddCurve(x[:-2])
print rs.AddCurve(x[:-2])
print a
#back to gh
sc.doc = ghdoc
print a
b= rs.AddCurve(x[1:])
print rs.AddCurve(x[1:])
print b
# ---------- end python_script ----------
python_script_2 = PythonScript(x=point)  # -> out, a; inputs x: list of Point3d
# ---------- python_script_2: Python ----------
print type(x[0])
import Rhino.Geometry as rg

a = rg.NurbsCurve.Create(False,3,x)
print a
# ---------- end python_script_2 ----------
python_script_3 = PythonScript(x=point)  # -> out, a, b; inputs x: list
# ---------- python_script_3: Python ----------
import Rhino.Geometry as rg
import rhinoscriptsyntax as rs
b = rs.AddCurve(x)
print type(b)
# ---------- end python_script_3 ----------
panel = Panel(python_script.a)
panel_2 = Panel(python_script.b)
object_bake = ObjectBake(BakeToggle=False, Layer="GH_Bake", ObjectName="GH_Obj", ObjectColor=RGB(255, 255, 255), LayerColor=RGB(255, 255, 255))
