# Grasshopper definition 学习用Python调用袋鼠插件0090pull_to_curve-改写成KR2.gh (Grasshopper 0.9.76)
# plug-ins: Python Interpreter, Kangaroo Components, Weaverbird, Kangaroo2 Components

number_slider = Slider(1, range=0.1..5)  # disabled
pop2d = Populate2D(Region={Plane=PlaneXY(2, 4, 0), Size=Domain2(u=0..29, v=0..23)}, Count=100, Seed=1)  # disabled
crv = Curve(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)  # disabled
number_slider_2 = Slider(1, range=0..10)
timer = Timer(TimerInterval=20, Target=python_script_3)  # disabled
number_slider_3 = Slider(1.156, range=0.1..5)
inter = InterconnectPoints(Pts=pop2d)  # disabled
panel = Panel("0.5")  # disabled
curve = Curve([<curve referenced from the Rhino model> x9])
pop2d_2 = Populate2D(Region={Plane=PlaneXY(2, 4, 0), Size=Domain2(u=0..29, v=0..23)}, Count=100, Seed=1)
crv_2 = Curve(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)
python_script = PythonScript()  # -> out, a; disabled
# ---------- python_script: Python ----------
import math
import rhinoscriptsyntax as rs 
import ghpythonlib.components as ghc
import Rhino.Geometry as rg
icurvesn=[]
icurvesm=[]
ipointssnm=[]
ipointssmn=[]
curve01=curves[0]
curve12=curves[1]
curve23=curves[2]
curve30=curves[3]
points01 = rs.DivideCurveLength(curve01,length)
points12 = rs.DivideCurveLength(curve12,length)
points23 = rs.DivideCurveLength(curve23,length)
points30 = rs.DivideCurveLength(curve30,length)
m=(len(points12)+len(points30))/2
n=(len(points01)+len(points23))/2


points01 = rs.DivideCurve(curve01,n+1)
points12 = rs.DivideCurve(curve12,m+1)
points23 = rs.DivideCurve(curve23,n+1)
points30 = rs.DivideCurve(curve30,m+1)
m=int(m)
n=int(n)
bpoints=points01+points12+points23+points30
for i in range(n): 
    icurve=rs.ShortPath(surface, points01[i+1], points23[-(i+2)])
    icurvesn.append(icurve)
count=0
while (count<loop):
    icurvesm=[]
    ipointssnm=[]
    for icurve in icurvesn: 
        ipoints = rs.DivideCurve(icurve,m+1)
        ipointssnm.append(ipoints)
#    global surfObj 
    surfObj= rs.coercerhinoobject(surface).Geometry
    print surfObj
    for i in range(m):
        ps=[]
        puvs=[]
        p=points30[-(i+1)-1]
        puv=ghc.SurfaceClosestPoint(p,surfObj)[1]
        puvs.append(puv)
        for j in range(n):
            #转换数据类型
            p=ipointssnm[j][i+1]
            puv=ghc.SurfaceClosestPoint(p,surfObj)[1]
            ps.append(p)
            puvs.append(puv)
        p=points12[i+1]
        puv=ghc.SurfaceClosestPoint(p,surfObj)[1]
        puvs.append(puv)
        print (count)
        print (puvs[2])
        crv=ghc.CurveOnSurface(surfObj,puvs,False)[0]
        icurvesm.append(crv)
        #print (crv)
    #print surfObj
    count=count+1
    if(count>=loop):
        print ('aaaaaaaaaaaaaaaaaaaaaaaaaaa')
        break
    icurvesn=[]
    ipointssmn=[]
    for icurve in icurvesm: 
        ipoints = rs.DivideCurve(icurve,n+1)
        ipointssmn.append(ipoints)
    global surfObj 
    surfObj= rs.coercerhinoobject(surface).Geometry
    print surfObj
    for i in range(n):
        ps=[]
        puvs=[]
        p=points01[(i+1)]
        puv=ghc.SurfaceClosestPoint(p,surfObj)[1]
        puvs.append(puv)
        for j in range(m):
            #转换数据类型
            p=ipointssmn[j][i+1]
            puv=ghc.SurfaceClosestPoint(p,surfObj)[1]
            ps.append(p)
            puvs.append(puv)
        p=points23[-(i+1)-1]
        puv=ghc.SurfaceClosestPoint(p,surfObj)[1]
        puvs.append(puv)
        crv=ghc.CurveOnSurface(surfObj,puvs,False)[0]
        icurvesn.append(crv)
    count=count+1
    if(count>=50):
        break
        

ipointss0=[]
ipointss1=[]
for icurve in icurvesn: 
    ipoints = rs.DivideCurve(icurve,m+1)
    ipointss0=ipointss0+ipoints
ipointss0=ipointss0+points12+points30
for icurve in icurvesm: 
    ipoints = rs.DivideCurve(icurve,n+1)
    ipointss1=ipointss1+ipoints
ipointss1=ipointss1+points01+points23



#以下代码无用
#icurvesn=tweenCurveOnsurface(n,m,icurvesm,points01,points23)
def tweenCurveOnsurface(m,n,icurves,points0,points1):
    print {'def'}
    print {m}
    for icurve in icurves:
        ipoints = rs.DivideCurve(icurve,m+1)
        ipointssnm.append(ipoints)
    for i in range(m):
        icurvesNew=[]
        ps=[]
        puvs=[]
        p=points1[(i+1)]
        puv=ghc.SurfaceClosestPoint(p,surfObj)[1]
        puvs.append(puv)
        for j in range(n):
            #转换数据类型
            p=ipointssnm[j][i+1]
            puv=ghc.SurfaceClosestPoint(p,surfObj)[1]
            ps.append(p)
            puvs.append(puv)
        p=points0[i+1]
        puv=ghc.SurfaceClosestPoint(p,surfObj)[1]
        puvs.append(puv)
        crv=ghc.CurveOnSurface(surfObj,puvs,False)[0]
        icurvesNew.append(crv)
        print (crv)
    return icurvesNew
# ---------- end python_script ----------
number_slider_4 = Slider(1.058, range=0.1..5)
weaverbird_s_mesh_from_lines_weave_back = WeaverbirdsMeshFromLinesWeaveBack(Lines=curve, MaximumValence=4)
inter_2 = InterconnectPoints(Pts=pop2d_2)
length = Length(Curve=inter_2)
springs = SpringsFromLine(
    Connection=inter,
    Stiffness=1000,
    Damping=10,
    RestLength=number_slider,
    UpperCutoff=number_slider,
    LowerCutoff=0,
    Plasticity=0)  # disabled
curvepull = CurvePull(Curve=crv, Points=pop2d, Strength=100)  # disabled
multiplication = Multiplication(A=number_slider, B=panel)  # disabled
timer_2 = Timer(TimerInterval=20, Target=stepsolver)
python_script_2 = PythonScript(x=length, y=number_slider_3)  # -> a
# ---------- python_script_2: Python ----------
a=x
if x>y:
    a=0
# ---------- end python_script_2 ----------
medges = MeshEdges(Mesh=weaverbird_s_mesh_from_lines_weave_back)  # -> NakedEdges, InteriorEdges, NonManifoldEdges

button = Button()  # disabled
timer_3 = Timer(TimerInterval=20, Target=kangaroo)  # disabled

python_script_3 = PythonScript(c=crv, ps=pop2d, b=button)  # -> out, ILines, P, S, Fs, points, points1; inputs ps: list; disabled
# ---------- python_script_3: Python ----------
import rhinoscriptsyntax as rs 
import ghpythonlib.components as ghc
import Rhino.Geometry as rg
import clr
#clr.AddReference("Grasshopper")
#clr.AddReference("KangarooLib0096")
#clr.AddReference("KangarooLib0096")
clr.AddReference("KangarooSolver")
import KangarooSolver as kl
pObjs=[]
for p in ps:
   pObj= rs.coercerhinoobject(p).Geometry
   pObjs.append(pObj)
#print pObjs
iLines=ghc.Kangaroo.interconnectPoints(pObjs)
cObj=rs.coercerhinoobject(c).Geometry
P=ghc.Kangaroo.CurvePull(cObj,pObjs,100)
S=ghc.Kangaroo.SpringsFromLine(iLines,1000,10,1,1,0)
#S=ghc.Kangaroo.SpringsFromLine(
#print S
print type(S[0])
print type(P)
Fs=[]
Fs=Fs+S
Fs.append(P)
points=ghc.Kangaroo.KangarooPhysics(Fs)[2]
set=ghc.Kangaroo.KangarooSettings()
kOut=ghc.Kangaroo.KangarooPhysics(Fs,None,set,None,True)
points=kOut[2]
iteration=kOut[1]
print iteration
#set1=ghc.Kangaroo.KangarooSettings(0.001,0.01,10)
#ghc.Kangaroo.KangarooPhysics.
kOut1=ghc.Kangaroo.KangarooPhysics(Fs,None,set,None,False)
print 'a',kOut1[0]
print type(kOut1)
points1=kOut1[2]
iteration=kOut1[1]
print iteration
print iteration
# ---------- end python_script_3 ----------
multiplication_2 = Multiplication(A=number_slider_3, B=0.5)
panel_2 = Panel(python_script_3.points1)  # disabled
clamplength = ClampLength(Line=inter_2, LowerLimit=number_slider_3, UpperLimit=10000, Strength=1000)
length_line = LengthLine(Line=inter_2, Length=python_script_2, Strength=10)  # disabled
oncurve = OnCurve(Points=pop2d_2, Curve=crv_2, Strength=10)
panel_3 = Panel(python_script_3.points)  # disabled
crv_3 = Curve([medges.NakedEdges, medges.InteriorEdges])
cluster = Cluster(M=weaverbird_s_mesh_from_lines_weave_back, strength=10, B=number_slider_4)
python_script_4 = PythonScript(c=flatten([curvepull, springs]), ps=pop2d)  # -> out, ILines, P, S, Fs, points; inputs c: list, ps: list; disabled
# ---------- python_script_4: Python ----------
import rhinoscriptsyntax as rs 
import ghpythonlib.components as ghc
import Rhino.Geometry as rg
print type(c)
# ---------- end python_script_4 ----------
len = Length(Curve=crv_3)
cir = Circle(Plane=python_script_3.points1, Radius=multiplication)  # disabled
kangaroo_settings = KangarooSettings(
    Tolerance=0.001,
    TimeStep=0.01,
    SubIterations=10,
    Floor=False,
    Drag=1,
    Restitution=0.7,
    StaticFriction=10,
    KineticFriction=10,
    Settle=2,
    Tumble=1,
    Sound=False,
    Solver=0)  # disabled
multiplication_3 = Multiplication(A=len, B=number_slider_4)
bouncysolver = BouncySolver(Reset=False, Threshold=1e-15, Tolerance=0.01, Damping=0.99, Iterations=10, On=True)  # -> I, V, O
zombiesolver = ZombieSolver(Threshold=1e-10, Tolerance=0.01, MaxIterations=50000)  # -> I, V, O
kangaroo = KangarooPhysics(ForceObjects=flatten([springs, curvepull]), Settings=null, SimulationReset=button)  # -> Out, Iterations, ParticlesOut, GeometryOut; disabled
cir_2 = Circle(Plane=python_script_3.points, Radius=multiplication)  # disabled
stepsolver = StepSolver(
    GoalObjects=[oncurve, clamplength, length_line],
    Tolerance=0.01,
    Momentum=Toggle(False),
    Damping=0.99,
    SubIterations=10,
    Animate=Toggle(False))  # -> I, V, O
equallength = EqualLength(Line=crv_3, Strength=1)
cir_3 = Circle(Plane=kangaroo.ParticlesOut, Radius=multiplication)  # disabled
solver = Solver(Reset=False, Threshold=1e-15, Tolerance=0.01, On=True)  # -> I, V, O
length_line_2 = LengthLine(Line=crv_3, Length=multiplication_3, Strength=10)
stepsolver_2 = StepSolver(Tolerance=0.01, Momentum=False, Damping=0.99, SubIterations=10)  # -> I, V, O; disabled
panel_4 = Panel(stepsolver.I)
point = Point(stepsolver.V)
timer_4 = Timer(TimerInterval=1000, Target=stepsolver_3)
panel_5 = Panel(kangaroo.Iterations)  # disabled
cir_4 = Circle(Plane=point, Radius=multiplication_2)
stepsolver_3 = StepSolver(GoalObjects=equallength, Tolerance=0.01, Momentum=Toggle(True), Damping=0.99, SubIterations=10, Animate=Toggle(False))  # -> I, V, O
number_slider_5 = Slider(1.342, range=0.1..5)
pop2d_3 = Populate2D(Region={Plane=PlaneXY(2, 4, 0), Size=Domain2(u=0..29, v=0..23)}, Count=100, Seed=1)
crv_4 = Curve(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)
panel_6 = Panel(stepsolver_3.I)
inter_3 = InterconnectPoints(Pts=pop2d_3)
line = Line(stepsolver_3.O)
springs_2 = SpringsFromLine(
    Connection=inter_3,
    Stiffness=1000,
    Damping=10,
    RestLength=number_slider_5,
    UpperCutoff=number_slider_5,
    LowerCutoff=0,
    Plasticity=0)
multiplication_4 = Multiplication(A=number_slider_5, B=0.5)
curvepull_2 = CurvePull(Curve=crv_4, Points=pop2d_3, Strength=100)
springsfrommesh = SpringsFromMesh(stiffness=1000, B=1)

timer_5 = Timer(TimerInterval=20, Target=kangaroo_2)

kangaroo_2 = KangarooPhysics(ForceObjects=flatten([springs_2, curvepull_2]), Settings=null, SimulationReset=Button())  # -> Out, Iterations, ParticlesOut, GeometryOut
cir_5 = Circle(Plane=kangaroo_2.ParticlesOut, Radius=multiplication_4)

# ==== cluster SpringsFromMesh: Turns all edges of a mesh into springs
M = ClusterInput()
medges = MeshEdges(Mesh=M)  # -> NakedEdges, InteriorEdges, NonManifoldEdges
crv = Curve([medges.NakedEdges, medges.InteriorEdges])
B = ClusterInput()
len = Length(Curve=crv)
multiplication = Multiplication(A=len, B=B)
stiffness = ClusterInput()
springs = SpringsFromLine(Connection=crv, Stiffness=stiffness, Damping=10, RestLength=multiplication, UpperCutoff=0, LowerCutoff=0, Plasticity=0)
S = ClusterOutput(springs)

# ==== cluster Cluster
B = ClusterInput()
strength = ClusterInput()
M = ClusterInput()
medges = MeshEdges(Mesh=M)  # -> NakedEdges, InteriorEdges, NonManifoldEdges
crv = Curve([medges.NakedEdges, medges.InteriorEdges])
len = Length(Curve=crv)
multiplication = Multiplication(A=len, B=B)
length_line = LengthLine(Line=crv, Length=multiplication, Strength=strength)
spring = ClusterOutput(length_line)
