# Grasshopper definition 学习用Python调用袋鼠插件0090pull_to_curve.gh (Grasshopper 0.9.76)
# plug-ins: Python Interpreter, Kangaroo Components, Kangaroo2 Components

number_slider = Slider(1, range=0.1..5)
pop2d = Populate2D(Region={Plane=PlaneXY(2, 4, 0), Size=Domain2(u=0..29, v=0..23)}, Count=100, Seed=1)
crv = Curve(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)
timer = Timer(TimerInterval=20, Target=python_script_2)  # disabled
inter = InterconnectPoints(Pts=pop2d)
python_script = PythonScript()  # -> out, a
# ---------- python_script: Python ----------
import math
import rhinoscriptsyntax as rs 
import ghpythonlib.components as ghc
import Rhino.Geometry as rg
icurvesn=[]
icurvesm=[]
ipointssnm=[]
ipointssmn=[]
curve01=curves[0]
curve12=curves[1]
curve23=curves[2]
curve30=curves[3]
points01 = rs.DivideCurveLength(curve01,length)
points12 = rs.DivideCurveLength(curve12,length)
points23 = rs.DivideCurveLength(curve23,length)
points30 = rs.DivideCurveLength(curve30,length)
m=(len(points12)+len(points30))/2
n=(len(points01)+len(points23))/2


points01 = rs.DivideCurve(curve01,n+1)
points12 = rs.DivideCurve(curve12,m+1)
points23 = rs.DivideCurve(curve23,n+1)
points30 = rs.DivideCurve(curve30,m+1)
m=int(m)
n=int(n)
bpoints=points01+points12+points23+points30
for i in range(n): 
    icurve=rs.ShortPath(surface, points01[i+1], points23[-(i+2)])
    icurvesn.append(icurve)
count=0
while (count<loop):
    icurvesm=[]
    ipointssnm=[]
    for icurve in icurvesn: 
        ipoints = rs.DivideCurve(icurve,m+1)
        ipointssnm.append(ipoints)
#    global surfObj 
    surfObj= rs.coercerhinoobject(surface).Geometry
    print surfObj
    for i in range(m):
        ps=[]
        puvs=[]
        p=points30[-(i+1)-1]
        puv=ghc.SurfaceClosestPoint(p,surfObj)[1]
        puvs.append(puv)
        for j in range(n):
            #转换数据类型
            p=ipointssnm[j][i+1]
            puv=ghc.SurfaceClosestPoint(p,surfObj)[1]
            ps.append(p)
            puvs.append(puv)
        p=points12[i+1]
        puv=ghc.SurfaceClosestPoint(p,surfObj)[1]
        puvs.append(puv)
        print (count)
        print (puvs[2])
        crv=ghc.CurveOnSurface(surfObj,puvs,False)[0]
        icurvesm.append(crv)
        #print (crv)
    #print surfObj
    count=count+1
    if(count>=loop):
        print ('aaaaaaaaaaaaaaaaaaaaaaaaaaa')
        break
    icurvesn=[]
    ipointssmn=[]
    for icurve in icurvesm: 
        ipoints = rs.DivideCurve(icurve,n+1)
        ipointssmn.append(ipoints)
    global surfObj 
    surfObj= rs.coercerhinoobject(surface).Geometry
    print surfObj
    for i in range(n):
        ps=[]
        puvs=[]
        p=points01[(i+1)]
        puv=ghc.SurfaceClosestPoint(p,surfObj)[1]
        puvs.append(puv)
        for j in range(m):
            #转换数据类型
            p=ipointssmn[j][i+1]
            puv=ghc.SurfaceClosestPoint(p,surfObj)[1]
            ps.append(p)
            puvs.append(puv)
        p=points23[-(i+1)-1]
        puv=ghc.SurfaceClosestPoint(p,surfObj)[1]
        puvs.append(puv)
        crv=ghc.CurveOnSurface(surfObj,puvs,False)[0]
        icurvesn.append(crv)
    count=count+1
    if(count>=50):
        break
        

ipointss0=[]
ipointss1=[]
for icurve in icurvesn: 
    ipoints = rs.DivideCurve(icurve,m+1)
    ipointss0=ipointss0+ipoints
ipointss0=ipointss0+points12+points30
for icurve in icurvesm: 
    ipoints = rs.DivideCurve(icurve,n+1)
    ipointss1=ipointss1+ipoints
ipointss1=ipointss1+points01+points23



#以下代码无用
#icurvesn=tweenCurveOnsurface(n,m,icurvesm,points01,points23)
def tweenCurveOnsurface(m,n,icurves,points0,points1):
    print {'def'}
    print {m}
    for icurve in icurves:
        ipoints = rs.DivideCurve(icurve,m+1)
        ipointssnm.append(ipoints)
    for i in range(m):
        icurvesNew=[]
        ps=[]
        puvs=[]
        p=points1[(i+1)]
        puv=ghc.SurfaceClosestPoint(p,surfObj)[1]
        puvs.append(puv)
        for j in range(n):
            #转换数据类型
            p=ipointssnm[j][i+1]
            puv=ghc.SurfaceClosestPoint(p,surfObj)[1]
            ps.append(p)
            puvs.append(puv)
        p=points0[i+1]
        puv=ghc.SurfaceClosestPoint(p,surfObj)[1]
        puvs.append(puv)
        crv=ghc.CurveOnSurface(surfObj,puvs,False)[0]
        icurvesNew.append(crv)
        print (crv)
    return icurvesNew
# ---------- end python_script ----------
springs = SpringsFromLine(
    Connection=inter,
    Stiffness=1000,
    Damping=10,
    RestLength=number_slider,
    UpperCutoff=number_slider,
    LowerCutoff=0,
    Plasticity=0)
curvepull = CurvePull(Curve=crv, Points=pop2d, Strength=100)
multiplication = Multiplication(A=number_slider, B="0.5")

button = Button()
timer_2 = Timer(TimerInterval=20, Target=kangaroo)  # disabled

python_script_2 = PythonScript(c=crv, ps=pop2d, b=button)  # -> out, ILines, P, S, Fs, points, points1; inputs ps: list
# ---------- python_script_2: Python ----------
import rhinoscriptsyntax as rs 
import ghpythonlib.components as ghc
import Rhino.Geometry as rg
pObjs=[]
for p in ps:
   pObj= rs.coercerhinoobject(p).Geometry
   pObjs.append(pObj)
#print pObjs
iLines=ghc.Kangaroo.interconnectPoints(pObjs)
cObj=rs.coercerhinoobject(c).Geometry
P=ghc.Kangaroo.CurvePull(cObj,pObjs,100)
S=ghc.Kangaroo.SpringsFromLine(iLines,1000,10,1,1,0)
#S=ghc.Kangaroo.SpringsFromLine(
#print S
print type(S[0])
print type(P)
Fs=[]
Fs=Fs+S
Fs.append(P)
points=ghc.Kangaroo.KangarooPhysics(Fs)[2]
set=ghc.Kangaroo.KangarooSettings()
kOut=ghc.Kangaroo.KangarooPhysics(Fs,None,set,None,True)
print type(kOut)
points=kOut[2]
iteration=kOut[1]
print iteration
#set1=ghc.Kangaroo.KangarooSettings(0.001,0.01,10)
ghc.Kangaroo.KangarooPhysics.
kOut1=ghc.Kangaroo.KangarooPhysics(Fs,None,set,None,False)
print 'a',kOut1[0]
print type(kOut1)
points1=kOut1[2]
iteration=kOut1[1]
print iteration
print iteration
# ---------- end python_script_2 ----------
panel = Panel(python_script_2.points1)
panel_2 = Panel(python_script_2.points)
python_script_3 = PythonScript(c=flatten([curvepull, springs]), ps=pop2d)  # -> out, ILines, P, S, Fs, points; inputs c: list, ps: list
# ---------- python_script_3: Python ----------
import rhinoscriptsyntax as rs 
import ghpythonlib.components as ghc
import Rhino.Geometry as rg
print type(c)
# ---------- end python_script_3 ----------
cir = Circle(Plane=python_script_2.points1, Radius=multiplication)
cir_2 = Circle(Plane=python_script_2.points, Radius=multiplication)
kangaroo_settings = KangarooSettings(
    Tolerance=0.001,
    TimeStep=0.01,
    SubIterations=10,
    Floor=False,
    Drag=1,
    Restitution=0.7,
    StaticFriction=10,
    KineticFriction=10,
    Settle=2,
    Tumble=1,
    Sound=False,
    Solver=0)
kangaroo = KangarooPhysics(ForceObjects=flatten(python_script_2.Fs), Settings=null, SimulationReset=button)  # -> Out, Iterations, ParticlesOut, GeometryOut
cir_3 = Circle(Plane=kangaroo.ParticlesOut, Radius=multiplication)
stepsolver = StepSolver(Tolerance=0.01, Momentum=False, Damping=0.99, SubIterations=10)  # -> I, V, O
panel_3 = Panel(kangaroo.Iterations)
