# Grasshopper definition 学习用Python调用袋鼠插件2.0 0090pull_to_curve-增加点阵到文件的输出读入.gh (Grasshopper 0.9.76)
# plug-ins: Python Interpreter, Kangaroo Components, Kangaroo2 Components

filename = Panel("points-pull")
pop2d = Populate2D(Region={Plane=PlaneXY(2, 4, 0), Size=Domain2(u=0..29, v=0..23)}, Count=100, Seed=1)
number_slider = Slider(1, range=0.1..5)
python_script = PythonScript(points=pop2d, initial=Toggle(False), filename=filename, recompute=Button())  # -> points; inputs points: list
# ---------- python_script: Python ----------
# Import the coordinates of point from a text file.
"""面板读入或文件读入布点.
  Inputs:
    points: 输入的布点. (list of points)
    initia: True就从面板读入，即输入的points；False就从文件读入点阵. (bool)
    filename: (string)
    recompute：没啥意义，就是为了让电池重新计算一次
  Outputs:
      points: 点阵 (list of points)
"""
import math
import rhinoscriptsyntax as rs 
import ghpythonlib.components as ghc
import Rhino.Geometry as rg
import sys
file='H:/3rd year/mesh generation based on rhino and grasshopper/python/py'
sys.path.append(file)
import ImportExportPoints as iep
#print help(ImportPoints.ImportPoints())
if not initial:
    path='H:\\3rd year\\mesh generation based on rhino and grasshopper\\python\\py\\ghpython-const\\'
    filename=path+str(filename)+'.txt'
    points=iep.ImportPoints(filename)
# ---------- end python_script ----------
crv = Curve(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)
python_script_2 = PythonScript()  # -> out, a
# ---------- python_script_2: Python ----------
import math
import rhinoscriptsyntax as rs 
import ghpythonlib.components as ghc
import Rhino.Geometry as rg
icurvesn=[]
icurvesm=[]
ipointssnm=[]
ipointssmn=[]
curve01=curves[0]
curve12=curves[1]
curve23=curves[2]
curve30=curves[3]
points01 = rs.DivideCurveLength(curve01,length)
points12 = rs.DivideCurveLength(curve12,length)
points23 = rs.DivideCurveLength(curve23,length)
points30 = rs.DivideCurveLength(curve30,length)
m=(len(points12)+len(points30))/2
n=(len(points01)+len(points23))/2


points01 = rs.DivideCurve(curve01,n+1)
points12 = rs.DivideCurve(curve12,m+1)
points23 = rs.DivideCurve(curve23,n+1)
points30 = rs.DivideCurve(curve30,m+1)
m=int(m)
n=int(n)
bpoints=points01+points12+points23+points30
for i in range(n): 
    icurve=rs.ShortPath(surface, points01[i+1], points23[-(i+2)])
    icurvesn.append(icurve)
count=0
while (count<loop):
    icurvesm=[]
    ipointssnm=[]
    for icurve in icurvesn: 
        ipoints = rs.DivideCurve(icurve,m+1)
        ipointssnm.append(ipoints)
#    global surfObj 
    surfObj= rs.coercerhinoobject(surface).Geometry
    print surfObj
    for i in range(m):
        ps=[]
        puvs=[]
        p=points30[-(i+1)-1]
        puv=ghc.SurfaceClosestPoint(p,surfObj)[1]
        puvs.append(puv)
        for j in range(n):
            #转换数据类型
            p=ipointssnm[j][i+1]
            puv=ghc.SurfaceClosestPoint(p,surfObj)[1]
            ps.append(p)
            puvs.append(puv)
        p=points12[i+1]
        puv=ghc.SurfaceClosestPoint(p,surfObj)[1]
        puvs.append(puv)
        print (count)
        print (puvs[2])
        crv=ghc.CurveOnSurface(surfObj,puvs,False)[0]
        icurvesm.append(crv)
        #print (crv)
    #print surfObj
    count=count+1
    if(count>=loop):
        print ('aaaaaaaaaaaaaaaaaaaaaaaaaaa')
        break
    icurvesn=[]
    ipointssmn=[]
    for icurve in icurvesm: 
        ipoints = rs.DivideCurve(icurve,n+1)
        ipointssmn.append(ipoints)
    global surfObj 
    surfObj= rs.coercerhinoobject(surface).Geometry
    print surfObj
    for i in range(n):
        ps=[]
        puvs=[]
        p=points01[(i+1)]
        puv=ghc.SurfaceClosestPoint(p,surfObj)[1]
        puvs.append(puv)
        for j in range(m):
            #转换数据类型
            p=ipointssmn[j][i+1]
            puv=ghc.SurfaceClosestPoint(p,surfObj)[1]
            ps.append(p)
            puvs.append(puv)
        p=points23[-(i+1)-1]
        puv=ghc.SurfaceClosestPoint(p,surfObj)[1]
        puvs.append(puv)
        crv=ghc.CurveOnSurface(surfObj,puvs,False)[0]
        icurvesn.append(crv)
    count=count+1
    if(count>=50):
        break
        

ipointss0=[]
ipointss1=[]
for icurve in icurvesn: 
    ipoints = rs.DivideCurve(icurve,m+1)
    ipointss0=ipointss0+ipoints
ipointss0=ipointss0+points12+points30
for icurve in icurvesm: 
    ipoints = rs.DivideCurve(icurve,n+1)
    ipointss1=ipointss1+ipoints
ipointss1=ipointss1+points01+points23



#以下代码无用
#icurvesn=tweenCurveOnsurface(n,m,icurvesm,points01,points23)
def tweenCurveOnsurface(m,n,icurves,points0,points1):
    print {'def'}
    print {m}
    for icurve in icurves:
        ipoints = rs.DivideCurve(icurve,m+1)
        ipointssnm.append(ipoints)
    for i in range(m):
        icurvesNew=[]
        ps=[]
        puvs=[]
        p=points1[(i+1)]
        puv=ghc.SurfaceClosestPoint(p,surfObj)[1]
        puvs.append(puv)
        for j in range(n):
            #转换数据类型
            p=ipointssnm[j][i+1]
            puv=ghc.SurfaceClosestPoint(p,surfObj)[1]
            ps.append(p)
            puvs.append(puv)
        p=points0[i+1]
        puv=ghc.SurfaceClosestPoint(p,surfObj)[1]
        puvs.append(puv)
        crv=ghc.CurveOnSurface(surfObj,puvs,False)[0]
        icurvesNew.append(crv)
        print (crv)
    return icurvesNew
# ---------- end python_script_2 ----------
timer = Timer(TimerInterval=20, Target=python_script_3)  # disabled
point = Point(python_script)
inter = InterconnectPoints(Pts=point)
springs = SpringsFromLine(
    Connection=inter,
    Stiffness=1000,
    Damping=10,
    RestLength=number_slider,
    UpperCutoff=number_slider,
    LowerCutoff=0,
    Plasticity=0)
curvepull = CurvePull(Curve=crv, Points=point, Strength=100)
multiplication = Multiplication(A=number_slider, B="0.5")

button = Button()
timer_2 = Timer(TimerInterval=20, Target=kangaroo)  # disabled

python_script_3 = PythonScript(c=crv, ps=point, b=button)  # -> out, ILines, P, S, Fs, points, points1; inputs ps: list
# ---------- python_script_3: Python ----------
import rhinoscriptsyntax as rs 
import ghpythonlib.components as ghc
import Rhino.Geometry as rg
pObjs=[]
for p in ps:
   pObj= rs.coercerhinoobject(p).Geometry
   pObjs.append(pObj)
#print pObjs
iLines=ghc.Kangaroo.interconnectPoints(pObjs)
cObj=rs.coercerhinoobject(c).Geometry
P=ghc.Kangaroo.CurvePull(cObj,pObjs,100)
S=ghc.Kangaroo.SpringsFromLine(iLines,1000,10,1,1,0)
#S=ghc.Kangaroo.SpringsFromLine(
#print S
print type(S[0])
print type(P)
Fs=[]
Fs=Fs+S
Fs.append(P)
points=ghc.Kangaroo.KangarooPhysics(Fs)[2]
set=ghc.Kangaroo.KangarooSettings()
kOut=ghc.Kangaroo.KangarooPhysics(Fs,None,set,None,True)
print type(kOut)
points=kOut[2]
iteration=kOut[1]
print iteration
#set1=ghc.Kangaroo.
kOut0=ghc.Kangaroo.KangarooPhysics(Fs,None,set,None,True)
#kOut0=ghc.Kangaroo.KangarooPhysics(
print 'a',kOut0[2]
kOut1=ghc.Kangaroo.KangarooPhysics(Fs,None,set,None,False)
print 'a',kOut1[0]
print type(kOut1)
points1=kOut1[2]
iteration=kOut1[1]
print iteration
print iteration
# ---------- end python_script_3 ----------
panel = Panel(python_script_3.points1)
panel_2 = Panel(python_script_3.points)
timer_3 = Timer(TimerInterval=1000, Target=kangaroo)  # disabled
python_script_4 = PythonScript(c=flatten([curvepull, springs]), ps=point)  # -> out, ILines, P, S, Fs, points; inputs c: list, ps: list
# ---------- python_script_4: Python ----------
import rhinoscriptsyntax as rs 
import ghpythonlib.components as ghc
import Rhino.Geometry as rg
print type(c)
# ---------- end python_script_4 ----------
cir = Circle(Plane=python_script_3.points1, Radius=multiplication)
cir_2 = Circle(Plane=python_script_3.points, Radius=multiplication)
kangaroo_settings = KangarooSettings(
    Tolerance=0.001,
    TimeStep=0.01,
    SubIterations=10,
    Floor=False,
    Drag=1,
    Restitution=0.7,
    StaticFriction=10,
    KineticFriction=10,
    Settle=2,
    Tumble=1,
    Sound=False,
    Solver=0)
kangaroo = KangarooPhysics(ForceObjects=flatten(python_script_3.Fs), Settings=null, SimulationReset=button)  # -> Out, Iterations, ParticlesOut, GeometryOut
timer_4 = Timer(TimerInterval=1000, Target=python_script_5)
point_2 = Point([Point(41.49419053, 10.3594886, 0), Point(44.57111316, 10.44002155, 0)])
stepsolver = StepSolver(Tolerance=0.01, Momentum=False, Damping=0.99, SubIterations=10)  # -> I, V, O
cir_3 = Circle(Plane=kangaroo.ParticlesOut, Radius=multiplication)
python_script_5 = PythonScript(x=point_2)  # -> out, a
# ---------- python_script_5: Python ----------
a=x
# ---------- end python_script_5 ----------
panel_3 = Panel(kangaroo.Iterations)
python_script_6 = PythonScript(filename="points")  # -> points
# ---------- python_script_6: Python ----------
# Import the coordinates of point from a text file.
"""Import the coordinates of point from a text file.
  Inputs:
    filename: The filename. (sring)
  Outputs:
    points: The list of points. (list of point)
"""
def ImportPoints(filename):
    if not filename: return
    
    #read each line from the file
    file = open(filename, "r")
    contents = file.readlines()
    file.close()

    # local helper function    
    def __point_from_string(text):
        items = text.strip("()\n").split(",")
        x = float(items[0])
        y = float(items[1])
        z = float(items[2])
        return x, y, z

    contents = [__point_from_string(line) for line in contents]
    points=rs.AddPoints(contents)
    return points

if( __name__ == "__main__" ):
    path='H:\\3rd year\\mesh generation based on rhino and grasshopper\\python\\py\\ghpython-const\\'
    filename=path+str(filename)+'.txt'
    points=ImportPoints(filename)
# ---------- end python_script_6 ----------
python_script_7 = PythonScript(filename="points", points=point_2)  # inputs points: list
# ---------- python_script_7: Python ----------
# Export the coordinates of point to a text file.
"""Export the coordinates of point to a text file.
  Inputs:
    filename: The filename. (sring)
    points: The list of points. (list of point)
  Outputs:
"""
import rhinoscriptsyntax as rs

def ExportPoints(objectIds,filename):
    if( objectIds==None ): return
    if( filename==None ): return
    """
    Using a 'with' loop to open the file, we do not need to clean
    up or close the file when we are done, Python takes care of it.
    Here, we'll write the points with a line break, otherwise
    all the points will end up on one line.
    """
    with open(filename, "w")as file:
        for id in objectIds:
            #process point clouds
            if( rs.IsPointCloud(id) ):
                points = rs.PointCloudPoints(id)
                for pt in points:
                    # convert the point list to a string, 
                    # add a new line character, and write to the file
                    file.write(str(pt)+ "\n")
            elif( rs.IsPoint(id) ):
                point = rs.PointCoordinates(id)
                file.write(str(point)+ "\n")

if( __name__ == '__main__' ):
    path='H:\\3rd year\\mesh generation based on rhino and grasshopper\\python\\py\\ghpython-const\\'
    filename=path+str(filename)+'.txt'
    print filename
    ExportPoints(points,filename)
# ---------- end python_script_7 ----------
python_script_8 = PythonScript()  # -> t
# ---------- python_script_8: Python ----------
import time
import math
path='H:\\3rd year\\mesh generation based on rhino and grasshopper\\python\\py\\ghpython-const\\'
filename=str(tag)+'.txt'
pathFilename=path+filename
print pathFilename
if b:
    t=0
else:
    f=open(pathFilename,'r')
    t=int(f.read())
    f.close()
    t=t+1
f=open(pathFilename,'w')
f.write('%d'%t)
f.close()
t=t/x
if t>math.pi*loop:
    t=math.pi*loop
# ---------- end python_script_8 ----------
python_script_9 = PythonScript()  # -> Out, A
point_3 = Point(python_script_5.a)
python_script_10 = PythonScript(filename="points")  # -> points; same code as python_script_6
data_recorder = DataRecorder(point_3, DataLimit=-10, RecordData=True)
python_script_11 = PythonScript(filename=filename, points=kangaroo.ParticlesOut)  # -> points; inputs points: list
# ---------- python_script_11: Python ----------
# Export the coordinates of point to a text file.
"""Export the coordinates of point to a text file.
  Inputs:
    filename: The filename. (sring)
    points: The list of points. (list of point)
  Outputs:
      points:exported points
"""
import math
import rhinoscriptsyntax as rs 
import ghpythonlib.components as ghc
import Rhino.Geometry as rg
import sys
file='H:/3rd year/mesh generation based on rhino and grasshopper/python/py'
sys.path.append(file)
import ImportExportPoints as iep

if( __name__ == '__main__' ):
    path='H:\\3rd year\\mesh generation based on rhino and grasshopper\\python\\py\\ghpython-const\\'
    filename=path+str(filename)+'.txt'
    print filename
    iep.ExportPoints(points,filename)
# ---------- end python_script_11 ----------
mapping_equidistribution_method_length = PythonScript(loop=1)  # -> bpoints, icurvesm, icurvesn, ipointssm, ipointssn; inputs curves: list
# ---------- mapping_equidistribution_method_length: Python ----------
# 等分法
"""在一个曲面上的四边形区域内生成等分曲线
  Inputs:
    surface: A surface. (Surface)
    curves: Four  end-to-end curves on the surface. (list of curve)
    length: The desired edge length. (float)
    loop: The number of loop. (int)
  Outputs:
    bpoints: The list of point on the boundary. (list of point)
    icurvesm: The list of curve created on principal direction. (list of curve)
    icurvesn: The list of curve created on secondary direction. (list of curve)
    ipointssm: The dividing points on the icurvesm. (list of point)
    ipointssn: The dividing points on the icurvesn. (list of point)
"""
import math
import rhinoscriptsyntax as rs 
import ghpythonlib.components as ghc
import Rhino.Geometry as rg
import sys
file='H:/3rd year/mesh generation based on rhino and grasshopper/python/py'
sys.path.append(file)
import GeodesicCurve_new
icurvesn=[]
icurvesm=[]
ipointssnm=[]
ipointssmn=[]
curve01=curves[0]
curve12=curves[1]
curve23=curves[2]
curve30=curves[3]
points01 = rs.DivideCurveLength(curve01,length)
points12 = rs.DivideCurveLength(curve12,length)
points23 = rs.DivideCurveLength(curve23,length)
points30 = rs.DivideCurveLength(curve30,length)
m=(len(points12)+len(points30))/2
n=(len(points01)+len(points23))/2

#以下代码和给定段数的等分法相同
points01 = rs.DivideCurve(curve01,n+1)
points12 = rs.DivideCurve(curve12,m+1)
points23 = rs.DivideCurve(curve23,n+1)
points30 = rs.DivideCurve(curve30,m+1)
m=int(m)
n=int(n)
bpoints=points01+points12+points23+points30
for i in range(n): 
    #icurve=rs.ShortPath(surface, points01[i+1], points23[-(i+2)])
    icurve=GeodesicCurve_new.GeodesicCurve(surface,[points01[i+1], points23[-(i+2)]])
    icurvesn.append(icurve)
count=0
while (count<loop):
    icurvesm=[]
    ipointssnm=[]
    for icurve in icurvesn: 
        ipoints = rs.DivideCurve(icurve,m+1)
        ipointssnm.append(ipoints)
#    global surfObj 
    surfObj= rs.coercerhinoobject(surface).Geometry
    print surfObj
    for i in range(m):
        ps=[]
        puvs=[]
        p=points30[-(i+1)-1]
        puv=ghc.SurfaceClosestPoint(p,surfObj)[1]
        puvs.append(puv)
        for j in range(n):
            #转换数据类型
            p=ipointssnm[j][i+1]
            puv=ghc.SurfaceClosestPoint(p,surfObj)[1]
            ps.append(p)
            puvs.append(puv)
        p=points12[i+1]
        puv=ghc.SurfaceClosestPoint(p,surfObj)[1]
        puvs.append(puv)
        print (count)
        print (puvs[2])
        crv=ghc.CurveOnSurface(surfObj,puvs,False)[0]
        icurvesm.append(crv)
        #print (crv)
    #print surfObj
    count=count+1
    if(count>=loop):
        print ('aaaaaaaaaaaaaaaaaaaaaaaaaaa')
        break
    icurvesn=[]
    ipointssmn=[]
    for icurve in icurvesm: 
        ipoints = rs.DivideCurve(icurve,n+1)
        ipointssmn.append(ipoints)
    global surfObj 
    surfObj= rs.coercerhinoobject(surface).Geometry
    print surfObj
    for i in range(n):
        ps=[]
        puvs=[]
        p=points01[(i+1)]
        puv=ghc.SurfaceClosestPoint(p,surfObj)[1]
        puvs.append(puv)
        for j in range(m):
            #转换数据类型
            p=ipointssmn[j][i+1]
            puv=ghc.SurfaceClosestPoint(p,surfObj)[1]
            ps.append(p)
            puvs.append(puv)
        p=points23[-(i+1)-1]
        puv=ghc.SurfaceClosestPoint(p,surfObj)[1]
        puvs.append(puv)
        crv=ghc.CurveOnSurface(surfObj,puvs,False)[0]
        icurvesn.append(crv)
    count=count+1
    if(count>=50):
        break
        

ipointssm=[]
ipointssn=[]
for icurve in icurvesn: 
    ipoints = rs.DivideCurve(icurve,m+1)
    ipointss0=ipointss0+ipoints
ipointssn=ipointss0+points12+points30
for icurve in icurvesm: 
    ipoints = rs.DivideCurve(icurve,n+1)
    ipointss1=ipointss1+ipoints
ipointssm=ipointss1+points01+points23
# ---------- end mapping_equidistribution_method_length ----------
panel_4 = Panel(data_recorder)
