# Grasshopper definition 学习用Python调用袋鼠插件TensileRelaxScript.gh (Grasshopper 0.9.76)
# plug-ins: Python Interpreter, MeshMachine, Kangaroo2 Components

mesh = Mesh(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)
timer = Timer(TimerInterval=1000, Target=customiteration)  # disabled
customiteration = CSharpScript(M=mesh, Reference="C:\Users\CHANT\AppData\Roaming\Grasshopper\Libraries\KangarooSolver.dll")  # -> out, A, B, C; inputs M: Mesh
# ---------- customiteration: C# ----------
    //initialize the solver
    var PS = new KangarooSolver.PhysicalSystem();
    var Goals = new List<IGoal>();

    //get the Mesh points and boundary status
    Point3d[] Pts = M.Vertices.ToPoint3dArray();
    bool[] Naked = M.GetNakedEdgePointStatus();

    for(int i = 0; i < M.Vertices.Count;i++)
    {
      PS.AddParticle(Pts[i], 1); //add a particle for every mesh vertex
      if(Naked[i])
      {Goals.Add(new KangarooSolver.Goals.Anchor(i, Pts[i], 10000));}// fix the boundaries strongly in place
    }

    for(int i = 0; i < M.TopologyEdges.Count;i++)
    {
      var Ends = M.TopologyEdges.GetTopologyVertices(i);
      int Start = M.TopologyVertices.MeshVertexIndices(Ends.I)[0];
      int End = M.TopologyVertices.MeshVertexIndices(Ends.J)[0];
      Goals.Add(new KangarooSolver.Goals.Spring(Start, End, 0, 1)); //for each edge, a spring with rest length 0, and strength 1
    }

    int counter = 0;
    double threshold = 1e-6;
    do
    {
      //Step forward, using these goals, with multi-threading on, and stopping if the threshold is reached
      PS.Step(Goals, true, threshold);
      counter++;
    }while(PS.GetvSum() > threshold && counter < 100);
    //GetvSum returns the current kinetic energy
    //always include a counter to prevent it getting stuck forever in case it cannot reach the given threshold

    //replace the mesh vertices with the relaxed ones
    M.Vertices.Clear();
    M.Vertices.AddVertices(PS.GetPositions());

    //Output the mesh, and how many iterations it took to converge
    A = M;
    B = counter;
    C = Goals;
# ---------- end customiteration ----------
python_script = PythonScript(M=mesh)  # -> out, PS, Pts, Goals; inputs M: Mesh
# ---------- python_script: Python ----------
import rhinoscriptsyntax as rs
import clr
clr.AddReference("Grasshopper")
#clr.AddReference("KangarooLib0096")
clr.AddReference("KangarooSolver")
import KangarooSolver as ks
Goals=[]
PS=ks.PhysicalSystem()
Pts= M.Vertices.ToPoint3dArray()
Naked = M.GetNakedEdgePointStatus()
for i in range(M.Vertices.Count):
    PS.AddParticle(Pts[i], 1)#//add a particle for every mesh vertex
    if(Naked[i]):
      Goals.Add(ks.Goals.Anchor(i, Pts[i], 10000))# fix the boundaries strongly in place
for i in range(M.TopologyEdges.Count):
    Ends = M.TopologyEdges.GetTopologyVertices(i)
    Start = M.TopologyVertices.MeshVertexIndices(Ends.I)[0]
    End = M.TopologyVertices.MeshVertexIndices(Ends.J)[0]
    #Goals.Add( ks.Goals.Spring(Start, End, 0, 1))
counter = 0
threshold = 1e-6
#Step forward, using these goals, with multi-threading on, and stopping if the threshold is reached
# ---------- end python_script ----------
panel = Panel(customiteration.C)
python_script_2 = PythonScript(M=mesh)  # -> out, PS, Pts, Goals; inputs M: Mesh
# ---------- python_script_2: Python ----------
import rhinoscriptsyntax as rs
import clr
clr.AddReference("Grasshopper")
#clr.AddReference("KangarooLib0096")
clr.AddReference("KangarooSolver")
import KangarooSolver as ks
print dir(ks)
Goals=[]
PS=ks.PhysicalSystem()
Pts= M.Vertices.ToPoint3dArray()
Naked = M.GetNakedEdgePointStatus()
for i in range(M.Vertices.Count):
    ks.PhysicalSystem.AddParticle(PS,Pts[i], 1)
    #PS.AddParticle(Pts[i], 1)#//add a particle for every mesh vertex
    if(Naked[i]):
      Goals.Add(ks.Goals.Anchor(i, Pts[i], 10000))# fix the boundaries strongly in place
for i in range(M.TopologyEdges.Count):
    Ends = M.TopologyEdges.GetTopologyVertices(i)
    Start = M.TopologyVertices.MeshVertexIndices(Ends.I)[0]
    End = M.TopologyVertices.MeshVertexIndices(Ends.J)[0]
    Goals.Add( ks.Goals.Spring(Start, End, 0, 1))
counter = 0
threshold = 1e-6
#Step forward, using these goals, with multi-threading on, and stopping if the threshold is reached
ig=ks.IGoal.Clone(Goals[500])
ik=Goals[500]
#isp=Goals[500].MemberwiseClone()
print type(ig),type(ik)
print ik is Goals[500]
print ig is Goals[500]
#print Goals[500].MemberwiseClone()
#Goals=list(Goals)
print Goals[0].__class__
while (True):
    print 'a'
    print type(Goals[500])
    print type(Goals)
    #print help(ks.IGoal)
    #print help(ks.Goals.Spring)
    #ks.PhysicalSystem.Step(PS,Goals, True, threshold)
    print ks.PhysicalSystem.GetType(Goals[0])
    #ks.PhysicalSystem.SimpleStep(PS,Goals)
    PS.Step(Goals, True, threshold)
    counter+=counter
    if not(PS.GetvSum() > threshold and counter < 100):
        break
M.Vertices.Clear();
M.Vertices.AddVertices(PS.GetPositions())
A = M
B = counter
# ---------- end python_script_2 ----------
python_script_3 = PythonScript()  # -> out, tree
# ---------- python_script_3: Python ----------
import rhinoscriptsyntax as rs
import clr
clr.AddReference("Grasshopper")
#clr.AddReference("KangarooLib0096")
clr.AddReference("KangarooSolver")
import KangarooSolver as ks
ks.PhysicalSystem()
import Grasshopper.Kernel.Data.GH_Path as ghpath
import Grasshopper.DataTree as datatree
#import System
tree = datatree[System.Object]()
path1 = ghpath(2,3)
path2 = ghpath(3,4)

tree.Add(5, path1)
tree.AddRange([0,1,2,3], path2)
# ---------- end python_script_3 ----------
stepsolver = StepSolver(Tolerance=0.01, Momentum=False, Damping=0.99, SubIterations=10)  # -> I, V, O
python_script_4 = PythonScript()  # -> out, a
# ---------- python_script_4: Python ----------
import rhinoscriptsyntax as rs
import clr
clr.AddReference("Grasshopper")
#clr.AddReference("KangarooLib0096")
#clr.AddReference("KangarooSolver")
import KangarooSolver as ks
#clr.AddReference("Plankton") 
import Plankton
#import KangarooLib0096
#print dir(rs)
ks.PhysicalSystem()
print rs.__file__
print ks.__file__
import Grasshopper.Kernel.Data.GH_Path as ghpath
import Grasshopper.DataTree as datatree
import System
tree = datatree[System.Object]()
path1 = ghpath(2,3)
path2 = ghpath(3,4)

tree.Add(5, path1)
tree.AddRange([0,1,2,3], path2)
# ---------- end python_script_4 ----------
explode_tree = ExplodeTree(Data=python_script_3.tree)  # -> Branch0, Branch1
stepsolver_2 = StepSolver(
    GoalObjects=python_script_2.Goals,
    Tolerance=0.01,
    Momentum=False,
    Damping=0.99,
    SubIterations=10,
    Animate=python_script_2.Pts)  # -> I, V, O
solver = Solver(GoalObjects=python_script_2.Goals, Reset=False, Threshold=1e-15, Tolerance=0.01, On=True)  # -> I, V, O
panel_2 = Panel(python_script_2.Goals)
solver_2 = Solver(Reset=False, Threshold=1e-15, Tolerance=0.01, On=True)  # -> I, V, O
bouncysolver = BouncySolver(Reset=False, Threshold=1e-15, Tolerance=0.01, Damping=0.99, Iterations=10, On=True)  # -> I, V, O
python_script_5 = PythonScript()  # -> out, a
# ---------- python_script_5: Python ----------
class c:
   a=0
   def init(self):
       c.a=c.a+1
m1=c()
m1.init()
print m1.a
m2=c()
m2.init()
print m2.a
m2.a=3
print m2.a
print c.a
print hasattr(m2,'init')
# ---------- end python_script_5 ----------
remesher = Remesher(Flip=1, PullStrength=0.8, Iterations=1, Reset=True)
